# Grasshopper definition example_file_all_components.gh (Grasshopper 1.0.8)
# plug-ins: RhinoCodePluginGH

# ----
# CUSTOM ASSEMBLY CONSTRAINTS
number_slider = Slider(90, range=0..100)
constraint = IronPython2Script(alpha=number_slider, beta=Slider(45, range=0..100))  # -> constraint, boundaries; inputs alpha: Double, beta: Double
#   port alpha: Horizontal constraint angle.
#   port beta: Vertical constraint angle.
#   port constraint: Constrained insertion space.
#   port boundaries: Boundary surfaces constraining the insertion space.
# ---------- constraint: IronPython ----------
__author__ = "Nicolas Rogeau"
__laboratory__ = "IBOIS, Laboratory for Timber Construction" 
__university__ = "EPFL, Ecole Polytechnique Federale de Lausanne"
__funding__ = "NCCR Digital Fabrication"
__version__ = "2024.08"
__license__ = "MIT License"
__repository__ = "https://github.com/nrogeau/Manis-timber-plate-joinery-solver"
__reference__ = "https://doi.org/10.1016/j.autcon.2021.103875"

import Grasshopper.Kernel as gh
import platesjoineryR8 as pj
import rhinoscriptsyntax as rs

sphere =  rs.AddSphere((0,0,0),1)
cutter = rs.AddPlanarSrf(rs.AddPolyline([(1,1,0),(1,-1,0),(-1,-1,0),(-1,1,0),(1,1,0)]))
hemisphere = rs.SplitBrep(sphere,cutter)[1]

if alpha is None: alpha = 90
if beta is None: beta = 45

boundaries = [cutter[0]]
cutter2 = rs.RotateObject(cutter,(0,0,0),90+(alpha/2),(0,1,0),(True))
cutter3 = rs.RotateObject(cutter,(0,0,0),90-(alpha/2),(0,1,0),(True))
cutter4 = rs.RotateObject(cutter,(0,0,0),90+(beta/2),(1,0,0),(True))
cutter5 = rs.RotateObject(cutter,(0,0,0),90-(beta/2),(1,0,0),(True))
boundaries.append(cutter2)
boundaries.append(cutter3)
boundaries.append(cutter4)
boundaries.append(cutter5)

if alpha == 0:
    if beta == 0:
        constraint = rs.AddPoint(0,0,1)
    else:
        arc = rs.AddArc(rs.WorldYZPlane(),1,beta)
        constraint = rs.RotateObject(arc,(0,0,0),90-(beta/2),(1,0,0),(True))
else:
    if beta == 0:
        arc = rs.AddArc(rs.WorldZXPlane(),1,alpha)
        constraint = rs.RotateObject(arc,(0,0,0),-(alpha/2),(0,1,0),(True))
    else:
        constraint = hemisphere
        if alpha<180:
            constraint = rs.SplitBrep(constraint,cutter2)[0]
            constraint = rs.SplitBrep(constraint,cutter3)[1]
        if beta<180:
            constraint = rs.SplitBrep(constraint,cutter4)[0]
            constraint = rs.SplitBrep(constraint,cutter5)[1]
# ---------- end constraint ----------
constraints = IronPython2Script(FF=constraint.constraint)  # -> constraints
#   port FF: Horizontal constraint angle.
#   port FS: Vertical constraint angle.
#   port constraints: Datatree containing all constraints for all contact types.
# ---------- constraints: IronPython ----------
__author__ = "Nicolas Rogeau"
__laboratory__ = "IBOIS, Laboratory for Timber Construction" 
__university__ = "EPFL, Ecole Polytechnique Federale de Lausanne"
__funding__ = "NCCR Digital Fabrication"
__version__ = "2024.08"
__license__ = "MIT License"
__repository__ = "https://github.com/nrogeau/Manis-timber-plate-joinery-solver"
__reference__ = "https://doi.org/10.1016/j.autcon.2021.103875"

import Grasshopper.Kernel as gh
import platesjoineryR8 as pj

constraints = [[], [], [], [], []]
if FF: constraints[0] = [FF]
if FS: constraints[1] = [FS]
if ES: constraints[2] = [ES]
if SS: constraints[3] = [SS]
if IN: constraints[4] = [IN]
constraints = pj.Toolbox.Data.list_to_datatree(constraints)
# ---------- end constraints ----------

# ----
# EXPORT TEXT FILE
toggle = BooleanToggle(False)
export_text = ExportText(run=toggle)  # inputs run: Boolean, text: list of String, folder: String, name: String, extension: String, date: Boolean, incremental: Boolean
#   port run: Export file if True.
#   port text: Text to export.
#   port extension: (Optional) Custom file extension.
#   port date: (Optional) Add the date of today to the file name.
#   port incremental: (Optional) Check for existing file with the same name and increment if necessary.
# ---------- export_text: Python ----------
__author__ = "Nicolas Rogeau"
__laboratory__ = "IBOIS, Laboratory for Timber Construction" 
__university__ = "EPFL, Ecole Polytechnique Federale de Lausanne"
__funding__ = "NCCR Digital Fabrication"
__version__ = "2024.08"
__license__ = "MIT License"
__repository__ = "https://github.com/nrogeau/Manis-timber-plate-joinery-solver"
__reference__ = "https://doi.org/10.1016/j.autcon.2021.103875"

import os

inc = incremental
ext = extension

if run is True:

    # gh doc path
    ghP = ghdoc.Path

    # folder and file name
    if name == None: name = 'this_script_has_no_name'
    if folder == None: folder = os.path.dirname(os.path.realpath(ghP))
    outputName = folder + '\\' + str(name) 

    # date
    if date is True:
        date = datetime.datetime.today()
        outputName += '_' + str(date.year) + '_' + str(date.month) + '_' + str(date.day)

    # extension
    if ext == None: ext = '.txt'

    # avoid overwrite
    if inc is True:
        i = 0
        iter = outputName + '_' + str(i) 
        while  os.path.exists(iter + str(ext)) and i<100: #safety
                i += 1
                iter = outputName + '_' + str(i)
        outputName = iter
    outputName += str(ext)

    # create file
    myFile = open(outputName,'w')

    # pass values to file
    if text != None: 
        for i in range(len(text)):
            myFile.write(str(text[i]))
            if i != len(text)-1:
                myFile.write('\n')

    # close file
    myFile.close()

    # confirm file write
    if os.stat(outputName).st_size > 0:
        print('File successfully written as ' + outputName)
    else:
        print('output file is empty - check your values')
# ---------- end export_text ----------

# ----
# BUILD MODEL
number_slider_2 = Slider(30, range=0..100)
brep = Brep([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])
sequence = DisplaySequence(breps=brep)

discretize_plates = DiscretizePlates(breps=brep, length=number_slider_2)  # -> breps; inputs breps: list of Brep, length: Double
#   port breps: List of breps following the order of the assembly sequence.
#   port breps: List of discretized Breps.
# ---------- discretize_plates: Python ----------
__author__ = "Nicolas Rogeau"
__laboratory__ = "IBOIS, Laboratory for Timber Construction" 
__university__ = "EPFL, Ecole Polytechnique Federale de Lausanne"
__funding__ = "NCCR Digital Fabrication"
__version__ = "2024.08"
__license__ = "MIT License"
__repository__ = "https://github.com/nrogeau/Manis-timber-plate-joinery-solver"
__reference__ = "https://doi.org/10.1016/j.autcon.2021.103875"

import platesjoineryR8 as pj
reload(pj)

if breps:
    if length == 0.0: length = 1
    breps = pj.Toolbox.Breps.discretizeCurvedBreps(breps, length=length)
# ---------- end discretize_plates ----------
sequence_to_datatree = SequenceToDatatree(sequence="[[1,4],[0,5],6]", data=discretize_plates)  # -> datatree, sequence, matched; inputs sequence: String, datatree: tree, data: list
#   port sequence: Sequence to convert to datatree.
#   port datatree: Datatree to convert to sequence.
#   port data: List of data to organize according to the sequence (if a datatree is provided, the newly generated sequence will be used).
#   port datatree: Generated datatree from sequence.
#   port sequence: Generated sequence from datatree.
#   port matched: Organized list matching sequence.
# ---------- sequence_to_datatree: Python ----------
__author__ = "Nicolas Rogeau"
__laboratory__ = "IBOIS, Laboratory for Timber Construction" 
__university__ = "EPFL, Ecole Polytechnique Federale de Lausanne"
__funding__ = "NCCR Digital Fabrication"
__version__ = "2024.08"
__license__ = "MIT License"
__repository__ = "https://github.com/nrogeau/Manis-timber-plate-joinery-solver"
__reference__ = "https://doi.org/10.1016/j.autcon.2021.103875"

import Grasshopper.Kernel as gh
import platesjoineryR8 as pj
import math
import copy
import ast
reload(pj)

seq = sequence
tree = datatree

if seq != None: 
    pj.Toolbox.Data.test_seq(seq)
    tree = pj.Toolbox.Data.seq_to_tree(seq)
if tree != None: seq = pj.Toolbox.Data.tree_to_seq(tree) 

dt= []
count = 0
sequence = copy.deepcopy(seq)
if sequence and data: 
    sequence = ast.literal_eval(sequence)
    for i in range(len(sequence)):
        if type(sequence[i]) is list:
            intlist = pj.Toolbox.Data.flatten_integer_list(sequence[i])
        else: intlist = [sequence[i]]
        sub = []
        for j in range(len(intlist)):
            sub.append(data[count])
            count += 1
        dt.append(sub)
    dt = pj.Toolbox.Data.list_to_datatree(dt)
matched = dt
datatree = tree
sequence = seq
# ---------- end sequence_to_datatree ----------

thicken_plates = ThickenPlates(breps=discretize_plates, new_thickness=Slider(150, range=0..2000), proportion=Slider(0.5, range=0..1))  # -> breps; inputs breps: list of Brep, new_thickness: Double, proportion: Double
#   port breps: Plate breps to scale.
#   port new_thickness: New thickness for to the plates.
#   port proportion: (Optional) Change the direction of the scaling (from 0 to 1, default = 0.5).
#   port breps: Updated breps.
# ---------- thicken_plates: Python ----------
__author__ = "Nicolas Rogeau"
__laboratory__ = "IBOIS, Laboratory for Timber Construction" 
__university__ = "EPFL, Ecole Polytechnique Federale de Lausanne"
__funding__ = "NCCR Digital Fabrication"
__version__ = "2024.08"
__license__ = "MIT License"
__repository__ = "https://github.com/nrogeau/Manis-timber-plate-joinery-solver"
__reference__ = "https://doi.org/10.1016/j.autcon.2021.103875"

import Grasshopper.Kernel as gh
import platesjoineryR8 as pj
import Rhino.Geometry as rg
import rhinoscriptsyntax as rs
import math
reload(pj)

if breps is None: ghenv.Component.AddRuntimeMessage(gh.GH_RuntimeMessageLevel.Warning, "Waiting to get breps as input.")
elif new_thickness is None or new_thickness == 0.0: ghenv.Component.AddRuntimeMessage(gh.GH_RuntimeMessageLevel.Warning, "Waiting to get new_thickness as input.")
else:
    if proportion is None: proportion = 0.5
    new_breps = []
    for brep in breps:
        #faces
        faces= brep.Faces
        sortedfaces = pj.Toolbox.Surfaces.sort_surfaces_by_area(faces)
        sortedfaces.reverse()
        top_and_bottom = [sortedfaces[0][0],sortedfaces[1][0]]
        bottom_face = pj.Toolbox.Surfaces.sort_surfaces_by_altitude(top_and_bottom)[0][0]
        top_face = pj.Toolbox.Surfaces.sort_surfaces_by_altitude(top_and_bottom)[1][0]

        #contour
        top_contour = pj.Toolbox.Surfaces.get_face_largest_contour(top_face)
        if type(top_contour) != rg.PolylineCurve: top_contour=top_contour.ToPolyline(0.01,0.01,0.01,10000)
        top_contour = pj.Toolbox.Curves.resimplify_Curve(top_contour)
        bottom_contour = pj.Toolbox.Surfaces.get_face_largest_contour(bottom_face)
        bottom_contour = pj.Toolbox.Curves.align_curve_direction(top_contour,bottom_contour)
        top_contour, bottom_contour = pj.Toolbox.Curves.match_seams(top_contour, bottom_contour)
        top_center = rs.CurveAreaCentroid(top_contour)[0]
        thickness = rg.Point3d.DistanceTo(top_center, rg.Brep.ClosestPoint(bottom_face, top_center))
        if new_thickness != thickness and new_thickness != None : 
            normal = rs.CurveNormal(top_contour)
            top_vertices = rs.PolylineVertices(top_contour)
            bottom_vertices = rs.PolylineVertices(bottom_contour)
            for i in range(len(bottom_vertices)):
                vec = rs.VectorCreate(top_vertices[i],bottom_vertices[i])
                vec = rs.VectorUnitize(vec)
                angle = rs.VectorAngle(normal, vec)
                factor = (new_thickness - thickness)/math.cos(math.radians(angle))
                top_vertices[i] = rs.MoveObject(top_vertices[i], factor*proportion*vec)
                bottom_vertices[i] = rs.MoveObject(bottom_vertices[i], -factor*(1-proportion)*vec)
            top_contour=rs.coercecurve(rs.AddPolyline(top_vertices))
            bottom_contour=rs.coercecurve(rs.AddPolyline(bottom_vertices))
            new_breps.append(pj.Toolbox.Breps.brep_from_2_poly(top_contour, bottom_contour))
    breps = new_breps
# ---------- end thicken_plates ----------
geo = Geometry(thicken_plates)
panel = Panel(sequence_to_datatree.datatree)
build_plate_model = IronPython2Script(run=Toggle(True), breps=discretize_plates, sequence="[[1,4],[0,5],6]", constraints=constraints)  # -> model, breps, sequence, log; inputs run: Boolean, breps: list of Brep, sequence: String, constraints: tree, discard: list of String
#   port run: Run solver if True.
#   port breps: List of breps following the order of the assembly sequence.
#   port sequence: Order of assembly of the plates (supports modular assembly logic). String format: "[0,2,3,[4,1],5]" (where each "[x]" is a module).
#   port constraints: Geometric constraints for each contact type. (Use "constraints" component)
#   port discard: List of pairs of plates to discard. Format: "(a,b)" = Discard contact between plates a and b.
#   port breps: List of re-ordered Breps.
#   port sequence: Re-ordered sequence.
#   port log: Message from solver.
# ---------- build_plate_model: IronPython ----------
__author__ = "Nicolas Rogeau"
__laboratory__ = "IBOIS, Laboratory for Timber Construction" 
__university__ = "EPFL, Ecole Polytechnique Federale de Lausanne"
__funding__ = "NCCR Digital Fabrication"
__version__ = "2024.08"
__license__ = "MIT License"
__repository__ = "https://github.com/nrogeau/Manis-timber-plate-joinery-solver"
__reference__ = "https://doi.org/10.1016/j.autcon.2021.103875"

import Grasshopper.Kernel as gh
import platesjoineryR8 as pj
reload(pj)

model = None
log = None
if breps:
    if run is True or run == None:
        if sequence is None:
            model = pj.PlateModel(breps,constraints=constraints,discard=[])
        else: model = pj.PlateModel(breps, sequence, constraints=constraints,discard=[])
        if model.count < len(breps): ghenv.Component.AddRuntimeMessage(gh.GH_RuntimeMessageLevel.Warning, "The provided sequence does not include all referenced breps.")
        breps = model.breps
        sequence = model.sequence
        log = model.log
else:
    ghenv.Component.AddRuntimeMessage(gh.GH_RuntimeMessageLevel.Warning, "Waiting to get breps as input.")
# ---------- end build_plate_model ----------

# ----
# JOINERY
number_slider_3 = Slider(5, range=0..10)
number_slider_4 = Slider(86, range=0..100)
number_slider_5 = Slider(6, range=0..10)
add_tenon_joint = IronPython2Script(
    model=build_plate_model.model,
    tenon_number=number_slider_3,
    tenon_length=number_slider_4,
    tenon_width=number_slider_4,
    tenon_spacing=number_slider_4)  # -> model, joints_positives, joints_negatives, joints_keys; inputs plates_pairs: list of String, tenon_number: Int32, tenon_length: Double, tenon_width: Double, tenon_spacing: Double, tenon_shift: Double
#   port plates_pairs: (Optional) List of pair of plates (a,b) to only add joints between those plates.
#   port tenon_number: The number of tenons to create for each contact zones.
#   port tenon_length: (Optional) The length of the tenons. Default value will fit plate thickness.
#   port tenon_width: The width of each tenon.
#   port tenon_spacing: The space between two tenons.
#   port tenon_shift: (Optional) Shift the tenons from their central position.
#   port model: Updated plate model.
#   port joints_positives: The joints to add to each plate.
#   port joints_negatives: The joints to subtract from each plate.
#   port joints_keys: The keys to insert in each plate.
# ---------- add_tenon_joint: IronPython ----------
__author__ = "Nicolas Rogeau"
__laboratory__ = "IBOIS, Laboratory for Timber Construction" 
__university__ = "EPFL, Ecole Polytechnique Federale de Lausanne"
__funding__ = "NCCR Digital Fabrication"
__version__ = "2024.08"
__license__ = "MIT License"
__repository__ = "https://github.com/nrogeau/Manis-timber-plate-joinery-solver"
__reference__ = "https://doi.org/10.1016/j.autcon.2021.103875"

import copy 
import Grasshopper.Kernel as gh
import platesjoineryR8 as pj
reload(pj)


joints_positives = []
joints_negatives = []
joints_keys = []

if model:
    model = copy.deepcopy(model)
    model.add_tenons(plates_pairs, 
        tenon_number,
        tenon_length, 
        tenon_width, 
        tenon_spacing,
        tenon_shift)

    for plate in model.plates:
        joints_positives.append(plate.joints_positives)
        joints_negatives.append(plate.joints_negatives)
        joints_keys.append(plate.joints_keys)
    joints_positives = pj.Toolbox.Data.list_to_datatree(joints_positives)
    joints_negatives = pj.Toolbox.Data.list_to_datatree(joints_negatives)
    joints_keys = pj.Toolbox.Data.list_to_datatree(joints_keys)
else:
    ghenv.Component.AddRuntimeMessage(gh.GH_RuntimeMessageLevel.Warning, "Waiting to get a model as input.")
# ---------- end add_tenon_joint ----------
add_finger_joint = IronPython2Script(
    model=add_tenon_joint.model,
    finger_number_1=number_slider_5,
    finger_number_2=number_slider_5,
    finger_length_1=number_slider_4,
    finger_length_2=number_slider_4,
    finger_width_1=number_slider_4,
    finger_width_2=number_slider_4,
    finger_shift=Slider(20, range=0..100))  # -> model, joints_positives, joints_negatives, joints_keys; inputs plates_pairs: list of String, finger_number_1: Int32, finger_number_2: Int32, finger_length_1: Double, finger_length_2: Double, finger_width_1: Double, finger_width_2: Double, finger_spacing: Double, finger_shift: Double, mirror: Boolean
#   port plates_pairs: (Optional) List of pair of plates (a,b) to only add joints between those plates.
#   port finger_number_1: The number of fingers on the first side.
#   port finger_number_2: The number of fingers on the second side.
#   port finger_length_1: (Optional) The length of the fingers on the first side. Default value will fit plate thickness.
#   port finger_length_2: (Optional) The length of the fingers on the second side. Default value will fit plate thickness.
#   port finger_width_2: The width of the fingers on the second side.
#   port finger_spacing: The space between two fingers.
#   port finger_shift: (Optional) Shift the fingers from their central position.
#   port mirror: Mirror the joint.
#   port model: Updated plate model.
#   port joints_positives: The joints to add to each plate.
#   port joints_negatives: The joints to subtract from each plate.
#   port joints_keys: The keys to insert in each plate.
# ---------- add_finger_joint: IronPython ----------
__author__ = "Nicolas Rogeau"
__laboratory__ = "IBOIS, Laboratory for Timber Construction" 
__university__ = "EPFL, Ecole Polytechnique Federale de Lausanne"
__funding__ = "NCCR Digital Fabrication"
__version__ = "2024.08"
__license__ = "MIT License"
__repository__ = "https://github.com/nrogeau/Manis-timber-plate-joinery-solver"
__reference__ = "https://doi.org/10.1016/j.autcon.2021.103875"

import copy
import Grasshopper.Kernel as gh
import platesjoineryR8 as pj 
reload(pj)

joints_positives = []
joints_negatives = []
joints_keys = []

if model:
    model = copy.deepcopy(model)
    model.add_fingers(plates_pairs,
            finger_number_1,
            finger_length_1,
            finger_width_1,
            finger_number_2,
            finger_length_2,
            finger_width_2,
            finger_spacing,
            finger_shift,
            mirror)

    for plate in model.plates:
        joints_positives.append(plate.joints_positives)
        joints_negatives.append(plate.joints_negatives)
        joints_keys.append(plate.joints_keys)
    joints_positives = pj.Toolbox.Data.list_to_datatree(joints_positives)
    joints_negatives = pj.Toolbox.Data.list_to_datatree(joints_negatives)
    joints_keys = pj.Toolbox.Data.list_to_datatree(joints_keys)
else:
    ghenv.Component.AddRuntimeMessage(gh.GH_RuntimeMessageLevel.Warning, "Waiting to get a model as input.")
# ---------- end add_finger_joint ----------
add_half_lap_joint = AddHalfLapJoint(model=add_finger_joint.model, proportion=Slider(0.4, range=0..1))  # -> model, joints_positives, joints_negatives, joints_keys; inputs plates_pairs: list of String, proportion: Double, tolerance: Double, min_angle: Double, straight_height: Double, fillet_height: Double, segments: Int32
#   port plates_pairs: (Optional) List of pair of plates (a,b) to only add joints between those plates.
#   port proportion: The proportion of the cut (default halflap = 0.5) between both pieces.
#   port tolerance: Chamfer the halflap joint to add more tolerance for assembly.
#   port min_angle: If joint with tolerance: minimum angle for the slope of the optional chamfer (usually around 45 degrees)."
#   port straight_height: If joint with tolerance: size of the part of the notch without chamfer.
#   port fillet_height: If joint with tolerance: size of the rounded part of the notch.
#   port segments: If joint with tolerance: number of segments for the discretization of the opening curve.
#   port model: Updated plate model.
#   port joints_positives: The joints to add to each plate.
#   port joints_negatives: The joints to subtract from each plate.
#   port joints_keys: The keys to insert in each plate.
# ---------- add_half_lap_joint: Python ----------
__author__ = "Nicolas Rogeau"
__laboratory__ = "IBOIS, Laboratory for Timber Construction" 
__university__ = "EPFL, Ecole Polytechnique Federale de Lausanne"
__funding__ = "NCCR Digital Fabrication"
__version__ = "2024.08"
__license__ = "MIT License"
__repository__ = "https://github.com/nrogeau/Manis-timber-plate-joinery-solver"
__reference__ = "https://doi.org/10.1016/j.autcon.2021.103875"

import copy
import Grasshopper.Kernel as gh
import platesjoineryR8 as pj 
reload(pj)

joints_positives = []
joints_negatives = []
joints_keys = []
if proportion == 0.0 or proportion == 1.0: proportion = 0.5
if model:
    model = copy.deepcopy(model)
    model.add_halflap(plates_pairs, 
        proportion,
        tolerance,
        min_angle,
        straight_height,
        fillet_height,
        segments)

    for plate in model.plates:
        joints_positives.append(plate.joints_positives)
        joints_negatives.append(plate.joints_negatives)
        joints_keys.append(plate.joints_keys)
    joints_positives = pj.Toolbox.Data.list_to_datatree(joints_positives)
    joints_negatives = pj.Toolbox.Data.list_to_datatree(joints_negatives)
    joints_keys = pj.Toolbox.Data.list_to_datatree(joints_keys)
else:
    ghenv.Component.AddRuntimeMessage(gh.GH_RuntimeMessageLevel.Warning, "Waiting to get a model as input.")
# ---------- end add_half_lap_joint ----------
toggle_2 = BooleanToggle(False)
number_slider_6 = Slider(20, range=0..100)
number_slider_7 = Slider(0, range=0..100)
add_dowel_joint = IronPython2Script(
    model=add_half_lap_joint.model,
    dowel_number=Slider(3, range=0..10),
    dowel_radius=Slider(10, range=0..10),
    dowel_tolerance=Slider(2, range=0..10),
    dowel_retreat_1=number_slider_6,
    dowel_retreat_2=number_slider_6,
    circle_radius=Slider(100, range=0..100),
    circle_rotation=Slider(45, range=0..100),
    dowel_angle_1=0,
    dowel_angle_2=0,
    parallel=False)  # -> model, joints_positives, joints_negatives, joints_keys; inputs plates_pairs: list of String, dowel_number: Int32, dowel_radius: Double, dowel_tolerance: Double, dowel_retreat_1: Double, dowel_retreat_2: Double, circle_radius: Double, circle_rotation: Double, dowel_angle_1: Double, dowel_angle_2: Double, parallel: Boolean, tile: Curve
#   port plates_pairs: (Optional) List of pair of plates (a,b) to only add joints between those plates.
#   port dowel_number: The number of dowels to create for each contact zones
#   port dowel_radius: The radius of the dowels.
#   port dowel_tolerance: The distance between the border of the hole and the dowel.
#   port dowel_retreat_1: The distance which separate the top of the surface of the first plate to one side of the dowel.
#   port dowel_retreat_2: The distance which separate the top of the surface of the second plate to the one side of the dowel.
#   port circle_radius: (In the case of several dowels) The radius of the circle on which the dowels are laying.
#   port circle_rotation: (In the case of several dowels) The rotation of the circle on which the dowels are laying.
#   port dowel_angle_1: The rotation of the dowel in the plane of the plate.
#   port dowel_angle_2: The rotation of the dowel through the plate.
#   port parallel: Align all dowels if True. Otherwise, the inclination of the dowels is directed towards the center of the joint.
#   port tile: (Optional) Geometric tile as polyline to customize the shape of the dowel. Tile should be drawn scale and centered on the world origin.
#   port model: Updated plate model.
#   port joints_positives: The joints to add to each plate.
#   port joints_negatives: The joints to subtract from each plate.
#   port joints_keys: The keys to insert in each plate.
# ---------- add_dowel_joint: IronPython ----------
__author__ = "Nicolas Rogeau"
__laboratory__ = "IBOIS, Laboratory for Timber Construction" 
__university__ = "EPFL, Ecole Polytechnique Federale de Lausanne"
__funding__ = "NCCR Digital Fabrication"
__version__ = "2024.08"
__license__ = "MIT License"
__repository__ = "https://github.com/nrogeau/Manis-timber-plate-joinery-solver"
__reference__ = "https://doi.org/10.1016/j.autcon.2021.103875"

import copy
import Grasshopper.Kernel as gh
import platesjoineryR8 as pj 
reload(pj)
        
joints_positives = []
joints_negatives = []
joints_keys = []

if model:
    model = copy.deepcopy(model)
    model.add_dowels(plates_pairs, 
        dowel_number,
        dowel_radius, 
        dowel_tolerance, 
        dowel_retreat_1, 
        dowel_retreat_2, 
        circle_radius, 
        circle_rotation, 
        dowel_angle_1,
        dowel_angle_2,
        parallel,
        tile)

    for plate in model.plates:
        joints_positives.append(plate.joints_positives)
        joints_negatives.append(plate.joints_negatives)
        joints_keys.append(plate.joints_keys)
    joints_positives = pj.Toolbox.Data.list_to_datatree(joints_positives)
    joints_negatives = pj.Toolbox.Data.list_to_datatree(joints_negatives)
    joints_keys = pj.Toolbox.Data.list_to_datatree(joints_keys)
else:
    ghenv.Component.AddRuntimeMessage(gh.GH_RuntimeMessageLevel.Warning, "Waiting to get a model as input.")
# ---------- end add_dowel_joint ----------
add_sunrise_joint = IronPython2Script(
    model=add_dowel_joint.model,
    tenon_number=Slider(3, range=0..10),
    tenon_width=Slider(100, range=0..100),
    tenon_spacing=Slider(100, range=0..1000),
    spread_angle=Slider(45, range=0..100),
    parallel_tenons=Toggle(False))  # -> model, joints_positives, joints_negatives, joints_keys; inputs plates_pairs: list of String, tenon_number: Int32, tenon_width: Double, tenon_spacing: Double, spread_angle: Double, parallel_tenons: Boolean
#   port plates_pairs: (Optional) List of pair of plates (a,b) to only add joints between those plates.
#   port tenon_number: The number of dowels to create for each contact zones
#   port tenon_width: The radius of the dowels.
#   port model: Updated plate model.
#   port joints_positives: The joints to add to each plate.
#   port joints_negatives: The joints to subtract from each plate.
#   port joints_keys: The keys to insert in each plate.
# ---------- add_sunrise_joint: IronPython ----------
__author__ = "Nicolas Rogeau"
__laboratory__ = "IBOIS, Laboratory for Timber Construction" 
__university__ = "EPFL, Ecole Polytechnique Federale de Lausanne"
__funding__ = "NCCR Digital Fabrication"
__version__ = "2024.08"
__license__ = "MIT License"
__repository__ = "https://github.com/nrogeau/Manis-timber-plate-joinery-solver"
__reference__ = "https://doi.org/10.1016/j.autcon.2021.103875"

import copy
import Grasshopper.Kernel as gh
import platesjoineryR8 as pj 
reload(pj)
        
joints_positives = []
joints_negatives = []
joints_keys = []

if model:
    model = copy.deepcopy(model)
    custom_insertion = None
    model.add_sunrise(plates_pairs, 
        tenon_number,
        tenon_width, 
        tenon_spacing,
        tenon_shift,
        spread_angle,
        parallel_tenons,
        custom_insertion)

    for plate in model.plates:
        joints_positives.append(plate.joints_positives)
        joints_negatives.append(plate.joints_negatives)
        joints_keys.append(plate.joints_keys)
    joints_positives = pj.Toolbox.Data.list_to_datatree(joints_positives)
    joints_negatives = pj.Toolbox.Data.list_to_datatree(joints_negatives)
    joints_keys = pj.Toolbox.Data.list_to_datatree(joints_keys)
else:
    ghenv.Component.AddRuntimeMessage(gh.GH_RuntimeMessageLevel.Warning, "Waiting to get a model as input.")
# ---------- end add_sunrise_joint ----------

# ----
# DISPLAY MODULAR ASSEMBLY
number_slider_8 = Slider(0, range=0..10)
split_decimal = IronPython2Script(num=number_slider_8)  # -> integer, decimal; inputs num: Double
#   port integer: Integer part.
#   port decimal: Decimal part.
# ---------- split_decimal: IronPython ----------
__author__ = "Nicolas Rogeau"
__laboratory__ = "IBOIS, Laboratory for Timber Construction" 
__university__ = "EPFL, Ecole Polytechnique Federale de Lausanne"
__funding__ = "NCCR Digital Fabrication"
__version__ = "2024.08"
__license__ = "MIT License"
__repository__ = "https://github.com/nrogeau/Manis-timber-plate-joinery-solver"
__reference__ = "https://doi.org/10.1016/j.autcon.2021.103875"

if num is not None:             
    st = str(num).split(".")
    integer = int(st[0])
    decimal = float("0."+st[1])
# ---------- end split_decimal ----------
get_modules = IronPython2Script(model=build_plate_model.model, module_id=split_decimal.integer)  # -> module, sequence, step; inputs module_id: Int32
#   port module: Module(s) inheriting model functions.
#   port sequence: Sub-sequence of the module.
#   port step: Tag representing the position of the module in the full assembly sequence. 'M' stands for the final step of the Model.
# ---------- get_modules: IronPython ----------
__author__ = "Nicolas Rogeau"
__laboratory__ = "IBOIS, Laboratory for Timber Construction" 
__university__ = "EPFL, Ecole Polytechnique Federale de Lausanne"
__funding__ = "NCCR Digital Fabrication"
__version__ = "2024.08"
__license__ = "MIT License"
__repository__ = "https://github.com/nrogeau/Manis-timber-plate-joinery-solver"
__reference__ = "https://doi.org/10.1016/j.autcon.2021.103875"

import rhinoscriptsyntax as rs
import Grasshopper.Kernel as gh
import platesjoineryR8 as pj
reload(pj)

if model:
    if module_id != None:
        module_id = module_id % len(model.modules)
        module = model.modules[module_id]
        breps = model.modules[module_id].breps
        step = str(model.modules[module_id].step)
        sequence = str(model.modules[module_id].sequence)
        assembly_vectors = []
        for i in range(len(model.modules[module_id].assembly_vectors)):
            vector = model.modules[module_id].assembly_vectors[i]
            if vector == "gravity": vector = rs.VectorCreate((0,0,-1),(0,0,0))
            assembly_vectors.append(pj.Toolbox.Vectors.round_vector(vector,6))
    else:
        module = []
        breps = []
        sequence = []
        step = []
        assembly_vectors = []
        for mod in model.modules:
            module.append(mod)
            breps.append(mod.breps)
            sequence.append(str(mod.sequence))
            step.append(str(mod.step))
            sub_assembly_vectors = []
            for vec in mod.assembly_vectors:
                if vec == "gravity": vec = rs.VectorCreate((0,0,-1),(0,0,0))
                sub_assembly_vectors.append(pj.Toolbox.Vectors.round_vector(vec,6))
            assembly_vectors.append(sub_assembly_vectors)
        breps = pj.Toolbox.Data.list_to_datatree(breps)
        assembly_vectors = pj.Toolbox.Data.list_to_datatree(assembly_vectors)
else:
    ghenv.Component.AddRuntimeMessage(gh.GH_RuntimeMessageLevel.Warning, "Waiting to get a model as input.")
# ---------- end get_modules ----------
animate_assembly = AnimateAssembly(module=get_modules.module, progress=split_decimal.decimal, retreat=Slider(500, range=0..1000), hold=Toggle(True))  # -> breps, status; inputs progress: Double, retreat: Double, hold: Boolean
#   port module: Plate module or plate model.
#   port progress: Animation progression from 0 to 1.
#   port retreat: Length of the insertion path.
#   port hold: If True, plates will be held in place during half of the progress bar, which allow to display to final result. If False, the display will only show plates on the move.
#   port breps: Show breps in motion.
#   port status: Assembly progression.
# ---------- animate_assembly: Python ----------
__author__ = "Nicolas Rogeau"
__laboratory__ = "IBOIS, Laboratory for Timber Construction" 
__university__ = "EPFL, Ecole Polytechnique Federale de Lausanne"
__funding__ = "NCCR Digital Fabrication"
__version__ = "2024.08"
__license__ = "MIT License"
__repository__ = "https://github.com/nrogeau/Manis-timber-plate-joinery-solver"
__reference__ = "https://doi.org/10.1016/j.autcon.2021.103875"

import ast 
import rhinoscriptsyntax as rs
import Grasshopper.Kernel as gh
import platesjoineryR8 as pj
reload(pj)

if module:
    # If model as input, take last module for animation.
    if hasattr(module, 'model') is False:
        module = module.modules[-1]

    #start of insertion
    if progress == 0: 
        status = ('start of insertion sequence')
    else:
        vectors = module.assembly_vectors
        count = module.count
        seq = ast.literal_eval(module.sequence)
        breps = []
        progress = progress * count
        deci = progress - int(progress)

        # animation
        for i in range(count):
            if vectors[i] == "gravity": vectors[i] = rs.VectorCreate((0,0,-1),(0,0,0))
            # standing plates
            if i < int(progress) :
                plate_ids = pj.Toolbox.Data.flatten_integer_list(seq[i])
                if type(plate_ids) is list:
                    for integer in plate_ids:
                        breps.append(rs.CopyObject(module.model.plates[integer].brep))
                else: breps.append(rs.CopyObject(module.model.plates[plate_ids].brep))
            # moving plates
            if i == int(progress) :
                if type(seq[i]) is list:
                    plate_ids = pj.Toolbox.Data.flatten_integer_list(seq[i])
                    for integer in plate_ids:
                        if hold is False:
                            breps.append(rs.CopyObject(module.model.plates[integer].brep, -(1-deci)*retreat*vectors[i]))
                        else:
                            if deci >= 0.5: eff_deci = 1
                            else: eff_deci = 2*deci
                            breps.append(rs.CopyObject(module.model.plates[integer].brep, -(1-eff_deci)*retreat*vectors[i]))
                else: 
                    if hold is False:
                        breps.append(rs.CopyObject(module.model.plates[seq[i]].brep, -(1-deci)*retreat*vectors[i]))
                    else:
                        if deci >= 0.5: eff_deci = 1
                        else: eff_deci = 2*deci
                        breps.append(rs.CopyObject(module.model.plates[seq[i]].brep, -(1-eff_deci)*retreat*vectors[i]))

        # ongoing status
        perc = 100*(progress - int(progress))
        status = ('plate '+ str(int(progress)) + ' inserted at ' + str(perc)+ ' %.')

        # end status
        if progress == 1: status = ('end of insertion sequence')

    if breps is not None: 
        for i in range(len(breps)): breps[i]= rs.coercebrep(breps[i])
else:
    ghenv.Component.AddRuntimeMessage(gh.GH_RuntimeMessageLevel.Warning, "Waiting to get a module or model as input.")
# ---------- end animate_assembly ----------
panel_2 = Panel(animate_assembly.status)
geo_2 = Geometry(animate_assembly.breps)

# ----
# EDIT PROPERTIES
panel_3 = Panel("top_contour")
edit_attributes = IronPython2Script(model=build_plate_model.model, attribute=panel_3)  # -> model, get_values; inputs attribute: String, set_values: tree
#   port attribute: Attribute to modify (e.g. 'top_face').
#   port set_values: Set new values for the specified attribute.
#   port model: Updated plate model.
#   port get_values: Get old or new values for the specified attribute.
# ---------- edit_attributes: IronPython ----------
__author__ = "Nicolas Rogeau"
__laboratory__ = "IBOIS, Laboratory for Timber Construction" 
__university__ = "EPFL, Ecole Polytechnique Federale de Lausanne"
__funding__ = "NCCR Digital Fabrication"
__version__ = "2024.08"
__license__ = "MIT License"
__repository__ = "https://github.com/nrogeau/Manis-timber-plate-joinery-solver"
__reference__ = "https://doi.org/10.1016/j.autcon.2021.103875"

import Grasshopper.Kernel as gh
import platesjoineryR8 as pj
import copy
reload(pj)

get_values=[]
if set_values != []: set_values = pj.Toolbox.Data.datatree_to_list(set_values)
if model:
    model = copy.deepcopy(model)
    new_items = set_values
    if attribute:
        try:
            attr = getattr(model, attribute)
            get=attr
            if new_items:
                if type(attr) != type(new_items):
                    raise Exception("You're trying to change attributes with the wrong data type!")
                elif len(attr) != len(new_items):
                    raise Exception("The provided list of new_items does not match the length of the list of attributes!")
                else: setattr(model, new_items)
        except:
            try:
                for i in range(model.count):
                    attr = getattr(model.plates[i], attribute)
                    get_values.append(attr)
                    if new_items:
                        if type(attr) != type(new_items[i]):
                            raise Exception("You're trying to change attributes with the wrong data type!")
                        elif model.count != len(new_items):
                            raise Exception("The provided list of new_items does not match the length of the list of attributes!")
                        else: 
                            setattr(model.plates[i], attribute, new_items[i])
            except ValueError: 
                print("""This is the list of all plate attributes:
                    temp
                    id
                    brep
                    top_face
                    bottom_face
                    top_contour
                    mid_contour
                    bottom_contour
                    top_holes
                    bottom_holes
                    top_center
                    bottom_center
                    plate_center
                    top_normal
                    bottom_normal
                    top_plane
                    bottom_plane
                    mid_plane
                    thickness
                    joints_positives
                    joints_negatives
                    joints_keys
                    top_milling_contour
                    bottom_milling_contour
                    top_milling_holes
                    bottom_milling_holes""")
                print("""This is the list of all model attributes:
                    temp
                    count
                    sequence
                    breps
                    plates
                    contact_ids
                    contact_pairs
                    contact_breps
                    contact_zones
                    contact_types
                    contact_strings
                    contact_centers
                    contact_normals
                    contact_planes
                    contact_vectors
                    needed_support
                    assembly_vectors
                    assembly_relatives
                    """)
if get_values != []:
    if type(get_values[0]) == list:
        get_values = list_to_datatree(get_values)
# ---------- end edit_attributes ----------
geo_3 = Geometry(edit_attributes.get_values)

# ----
# PLATE PROPERTIES
plate_contours = IronPython2Script(model=add_tenon_joint.model)  # -> top_contour, mid_contour, bottom_contour
#   port top_contour: The contour of the top surface of each plate.
#   port mid_contour: The contour of the mid surface of each plate.
#   port bottom_contour: The contour of the bottom surface of each plate.
# ---------- plate_contours: IronPython ----------
__author__ = "Nicolas Rogeau"
__laboratory__ = "IBOIS, Laboratory for Timber Construction" 
__university__ = "EPFL, Ecole Polytechnique Federale de Lausanne"
__funding__ = "NCCR Digital Fabrication"
__version__ = "2024.08"
__license__ = "MIT License"
__repository__ = "https://github.com/nrogeau/Manis-timber-plate-joinery-solver"
__reference__ = "https://doi.org/10.1016/j.autcon.2021.103875"

import Grasshopper.Kernel as gh
import platesjoineryR8 as pj 
reload(pj)

if model:
    top_contour = [plate.top_contour for plate in model.plates]
    mid_contour = [plate.mid_contour for plate in model.plates]
    bottom_contour = [plate.bottom_contour for plate in model.plates]
else:
    ghenv.Component.AddRuntimeMessage(gh.GH_RuntimeMessageLevel.Warning, "Waiting to get a model as input.")
# ---------- end plate_contours ----------
plate_joints = IronPython2Script(model=add_sunrise_joint.model)  # -> joints_positives, joints_negatives, joints_keys
#   port joints_positives: The joints to add to each plate.
#   port joints_negatives: The joints to subtract from each plate.
#   port joints_keys: The keys to insert in each plate.
# ---------- plate_joints: IronPython ----------
__author__ = "Nicolas Rogeau"
__laboratory__ = "IBOIS, Laboratory for Timber Construction" 
__university__ = "EPFL, Ecole Polytechnique Federale de Lausanne"
__funding__ = "NCCR Digital Fabrication"
__version__ = "2024.08"
__license__ = "MIT License"
__repository__ = "https://github.com/nrogeau/Manis-timber-plate-joinery-solver"
__reference__ = "https://doi.org/10.1016/j.autcon.2021.103875"

import Grasshopper.Kernel as gh
import platesjoineryR8 as pj 
reload(pj)

if model:
    joints_positives = [plate.joints_positives for plate in model.plates]
    joints_negatives = [plate.joints_negatives for plate in model.plates]
    joints_keys = [plate.joints_keys for plate in model.plates]
    joints_positives = pj.Toolbox.Data.list_to_datatree(joints_positives)
    joints_negatives = pj.Toolbox.Data.list_to_datatree(joints_negatives)
    joints_keys = pj.Toolbox.Data.list_to_datatree(joints_keys)
else:
    ghenv.Component.AddRuntimeMessage(gh.GH_RuntimeMessageLevel.Warning, "Waiting to get a model as input.")
# ---------- end plate_joints ----------
plate_vectors = IronPython2Script(module=get_modules.module)  # -> assembly_list, assembly_tree, relatives, spaces
#   port module: Plate module or plate model.
#   port assembly_list: Assembly vector of each plate in the module.
#   port assembly_tree: Assembly vector of each group of plates (sub-module) in the module.
#   port relatives: Neighbours concerned by the assembly.
#   port spaces: Intersection of insertion spaces with relatives.
# ---------- plate_vectors: IronPython ----------
__author__ = "Nicolas Rogeau"
__laboratory__ = "IBOIS, Laboratory for Timber Construction" 
__university__ = "EPFL, Ecole Polytechnique Federale de Lausanne"
__funding__ = "NCCR Digital Fabrication"
__version__ = "2024.08"
__license__ = "MIT License"
__repository__ = "https://github.com/nrogeau/Manis-timber-plate-joinery-solver"
__reference__ = "https://doi.org/10.1016/j.autcon.2021.103875"

import ast 
from Rhino.Geometry import Vector3d
import Grasshopper.Kernel as gh
import platesjoineryR8 as pj
reload(pj)

if module:
    if hasattr(module, 'model') is False:
        module = module.modules[-1]
    assembly_list = []
    assembly_tree = []
    seq = ast.literal_eval(module.sequence)
    for i in range(len(seq)):
        plate_ids = pj.Toolbox.Data.flatten_integer_list(seq[i])
        if type(plate_ids) is list:
            n = len(plate_ids)
        else: n = 1
        print plate_ids, n
        vec = module.assembly_vectors[i]
        if vec == "gravity": vec = Vector3d(0,0,-1)
        assembly_list.extend([vec] * n)
        assembly_tree.append([vec])
    assembly_tree = pj.Toolbox.Data.list_to_datatree(assembly_tree)
    relatives = pj.Toolbox.Data.list_to_datatree(module.assembly_relatives)
    spaces = pj.Toolbox.Data.list_to_datatree(module.assembly_spaces)
else:
    ghenv.Component.AddRuntimeMessage(gh.GH_RuntimeMessageLevel.Warning, "Waiting to get a module or model as input.")
# ---------- end plate_vectors ----------
plate_holes = IronPython2Script(model=build_plate_model.model)  # -> top_holes, bottom_holes
#   port top_holes: The holes of the top surface of each plate.
#   port bottom_holes: The holes of the bottom surface of each plate.
# ---------- plate_holes: IronPython ----------
__author__ = "Nicolas Rogeau"
__laboratory__ = "IBOIS, Laboratory for Timber Construction" 
__university__ = "EPFL, Ecole Polytechnique Federale de Lausanne"
__funding__ = "NCCR Digital Fabrication"
__version__ = "2024.08"
__license__ = "MIT License"
__repository__ = "https://github.com/nrogeau/Manis-timber-plate-joinery-solver"
__reference__ = "https://doi.org/10.1016/j.autcon.2021.103875"

import Grasshopper.Kernel as gh
import platesjoineryR8 as pj
reload(pj)

if model:
    top_holes = [plate.top_holes for plate in model.plates]
    bottom_holes = [plate.bottom_holes for plate in model.plates]
    top_holes = pj.Toolbox.Data.list_to_datatree(top_holes)
    bottom_holes = pj.Toolbox.Data.list_to_datatree(bottom_holes)
else:
    ghenv.Component.AddRuntimeMessage(gh.GH_RuntimeMessageLevel.Warning, "Waiting to get a model as input.")
# ---------- end plate_holes ----------
plate_planes = IronPython2Script(model=build_plate_model.model)  # -> top_plane, mid_plane, bottom_plane
#   port top_plane: The plane of the top surface of each plate.
#   port mid_plane: The plane of the mid surface of each plate.
#   port bottom_plane: The plane of the bottom surface of each plate.
# ---------- plate_planes: IronPython ----------
__author__ = "Nicolas Rogeau"
__laboratory__ = "IBOIS, Laboratory for Timber Construction" 
__university__ = "EPFL, Ecole Polytechnique Federale de Lausanne"
__funding__ = "NCCR Digital Fabrication"
__version__ = "2024.08"
__license__ = "MIT License"
__repository__ = "https://github.com/nrogeau/Manis-timber-plate-joinery-solver"
__reference__ = "https://doi.org/10.1016/j.autcon.2021.103875"

import Grasshopper.Kernel as gh

if model:
    top_plane = [plate.top_plane for plate in model.plates]
    mid_plane = [plate.mid_plane for plate in model.plates]
    bottom_plane = [plate.bottom_plane for plate in model.plates]

else:
    ghenv.Component.AddRuntimeMessage(gh.GH_RuntimeMessageLevel.Warning, "Waiting to get a model as input.")
# ---------- end plate_planes ----------
plate_faces = IronPython2Script(model=build_plate_model.model)  # -> top_face, bottom_face
#   port top_face: The top surface of each plate.
#   port bottom_face: The bottom surface of each plate.
# ---------- plate_faces: IronPython ----------
__author__ = "Nicolas Rogeau"
__laboratory__ = "IBOIS, Laboratory for Timber Construction" 
__university__ = "EPFL, Ecole Polytechnique Federale de Lausanne"
__funding__ = "NCCR Digital Fabrication"
__version__ = "2024.08"
__license__ = "MIT License"
__repository__ = "https://github.com/nrogeau/Manis-timber-plate-joinery-solver"
__reference__ = "https://doi.org/10.1016/j.autcon.2021.103875"

import Grasshopper.Kernel as gh

if model:
    top_face = [plate.top_face for plate in model.plates]
    bottom_face = [plate.bottom_face for plate in model.plates]
else:
    ghenv.Component.AddRuntimeMessage(gh.GH_RuntimeMessageLevel.Warning, "Waiting to get a model as input.")
# ---------- end plate_faces ----------
plate_thickness = IronPython2Script(model=build_plate_model.model)  # -> thickness
#   port thickness: Thickness of each plate.
# ---------- plate_thickness: IronPython ----------
__author__ = "Nicolas Rogeau"
__laboratory__ = "IBOIS, Laboratory for Timber Construction" 
__university__ = "EPFL, Ecole Polytechnique Federale de Lausanne"
__funding__ = "NCCR Digital Fabrication"
__version__ = "2024.08"
__license__ = "MIT License"
__repository__ = "https://github.com/nrogeau/Manis-timber-plate-joinery-solver"
__reference__ = "https://doi.org/10.1016/j.autcon.2021.103875"

import Grasshopper.Kernel as gh

if model:
    thickness = [plate.thickness for plate in model.plates ]
else:
    ghenv.Component.AddRuntimeMessage(gh.GH_RuntimeMessageLevel.Warning, "Waiting to get a model as input.")
# ---------- end plate_thickness ----------
multiplication = Multiplication(A=plate_vectors.assembly_list, B=100)
vdis = VectorDisplay(Anchor=plate_planes.mid_plane, Vector=multiplication)

# ----
# MODEL PROPERTIES
contact_neighbours = IronPython2Script(model=build_plate_model.model)  # -> ids, pairs, neighbours
#   port ids: The list of neighbours IDs organized as a tree.
#   port pairs: The list of neighbours IDs organized by pairs.
#   port neighbours: Neighbours of each plate as Breps.
# ---------- contact_neighbours: IronPython ----------
__author__ = "Nicolas Rogeau"
__laboratory__ = "IBOIS, Laboratory for Timber Construction" 
__university__ = "EPFL, Ecole Polytechnique Federale de Lausanne"
__funding__ = "NCCR Digital Fabrication"
__version__ = "2024.08"
__license__ = "MIT License"
__repository__ = "https://github.com/nrogeau/Manis-timber-plate-joinery-solver"
__reference__ = "https://doi.org/10.1016/j.autcon.2021.103875"

import Grasshopper.Kernel as gh
import platesjoineryR8 as pj

if model:
    ids = pj.Toolbox.Data.list_to_datatree(model.contact_ids)
    pairs = pj.Toolbox.Data.list_to_datatree(model.contact_pairs)
    neighbours = pj.Toolbox.Data.list_to_datatree(model.contact_breps)
else:
    ghenv.Component.AddRuntimeMessage(gh.GH_RuntimeMessageLevel.Warning, "Waiting to get a model as input.")
# ---------- end contact_neighbours ----------
contact_spaces = IronPython2Script(model=build_plate_model.model)  # -> spheres, grouped; inputs scale: Double
#   port scale: Scale factor.
#   port spheres: Local insertion spaces represented as spheres centered on each contact zone.
#   port grouped: Local insertion spaces represented as spheres grouped at the origin.
# ---------- contact_spaces: IronPython ----------
__author__ = "Nicolas Rogeau"
__laboratory__ = "IBOIS, Laboratory for Timber Construction" 
__university__ = "EPFL, Ecole Polytechnique Federale de Lausanne"
__funding__ = "NCCR Digital Fabrication"
__version__ = "2024.08"
__license__ = "MIT License"
__repository__ = "https://github.com/nrogeau/Manis-timber-plate-joinery-solver"
__reference__ = "https://doi.org/10.1016/j.autcon.2021.103875"

import Grasshopper.Kernel as gh
import Rhino.Geometry as rg
import platesjoineryR8 as pj
from copy import deepcopy as copy

if model:
    if scale is None: scale = 1
    if model:
        spheres = copy(model.contact_spheres)
        grouped = copy(model.contact_spheres)
        for i in range(len(model.contact_spheres)):
            for j in range(len(model.contact_spheres[i])):
                scale_transform = rg.Transform.Scale(model.contact_centers[i][j], scale)
                spheres[i][j].Transform(scale_transform)
                translation_vector = -rg.Vector3d(model.contact_centers[i][j])
                translation_transform = rg.Transform.Translation(translation_vector)
                grouped[i][j] = model.contact_spheres[i][j].Duplicate()
                grouped[i][j].Transform(translation_transform)
                scale_transform_grouped = rg.Transform.Scale(rg.Point3d(0, 0, 0), scale)
                grouped[i][j].Transform(scale_transform_grouped)
        spheres = pj.Toolbox.Data.list_to_datatree(spheres)
        grouped = pj.Toolbox.Data.list_to_datatree(grouped)   
else:
    ghenv.Component.AddRuntimeMessage(gh.GH_RuntimeMessageLevel.Warning, "Waiting to get a model as input.")
# ---------- end contact_spaces ----------
contact_vectors = IronPython2Script(model=build_plate_model.model)  # -> insertion
#   port insertion: The list of neighbours IDs organized as a tree.
# ---------- contact_vectors: IronPython ----------
__author__ = "Nicolas Rogeau"
__laboratory__ = "IBOIS, Laboratory for Timber Construction" 
__university__ = "EPFL, Ecole Polytechnique Federale de Lausanne"
__funding__ = "NCCR Digital Fabrication"
__version__ = "2024.08"
__license__ = "MIT License"
__repository__ = "https://github.com/nrogeau/Manis-timber-plate-joinery-solver"
__reference__ = "https://doi.org/10.1016/j.autcon.2021.103875"

import Grasshopper.Kernel as gh
import platesjoineryR8 as pj

if model:
    insertion = pj.Toolbox.Data.list_to_datatree(model.contact_vectors)
else:
    ghenv.Component.AddRuntimeMessage(gh.GH_RuntimeMessageLevel.Warning, "Waiting to get a model as input.")
# ---------- end contact_vectors ----------
contact_types = IronPython2Script(model=build_plate_model.model)  # -> types, strings
#   port types: Types of connections. (F=Face, S=Side, E=Edge, IN=Intersected).
#   port strings: Explicit description of the contact type.
# ---------- contact_types: IronPython ----------
__author__ = "Nicolas Rogeau"
__laboratory__ = "IBOIS, Laboratory for Timber Construction" 
__university__ = "EPFL, Ecole Polytechnique Federale de Lausanne"
__funding__ = "NCCR Digital Fabrication"
__version__ = "2024.08"
__license__ = "MIT License"
__repository__ = "https://github.com/nrogeau/Manis-timber-plate-joinery-solver"
__reference__ = "https://doi.org/10.1016/j.autcon.2021.103875"

import Grasshopper.Kernel as gh
import platesjoineryR8 as pj

if model:
    types = pj.Toolbox.Data.list_to_datatree(model.contact_types)
    strings = pj.Toolbox.Data.list_to_datatree(model.contact_strings)
else:
    ghenv.Component.AddRuntimeMessage(gh.GH_RuntimeMessageLevel.Warning, "Waiting to get a model as input.")
# ---------- end contact_types ----------
contact_zones = IronPython2Script(model=build_plate_model.model)  # -> zones, planes
#   port zones: Contact zone as surface.
#   port planes: Centered plane of the contact zone.
# ---------- contact_zones: IronPython ----------
__author__ = "Nicolas Rogeau"
__laboratory__ = "IBOIS, Laboratory for Timber Construction" 
__university__ = "EPFL, Ecole Polytechnique Federale de Lausanne"
__funding__ = "NCCR Digital Fabrication"
__version__ = "2024.08"
__license__ = "MIT License"
__repository__ = "https://github.com/nrogeau/Manis-timber-plate-joinery-solver"
__reference__ = "https://doi.org/10.1016/j.autcon.2021.103875"

import Grasshopper.Kernel as gh
import platesjoineryR8 as pj

if model:
    zones = pj.Toolbox.Data.list_to_datatree(model.contact_zones)
    planes = pj.Toolbox.Data.list_to_datatree(model.contact_planes)
else:
    ghenv.Component.AddRuntimeMessage(gh.GH_RuntimeMessageLevel.Warning, "Waiting to get a model as input.")
# ---------- end contact_zones ----------
multiplication_2 = Multiplication(A=contact_vectors, B=100)
vdis_2 = VectorDisplay(Anchor=contact_zones.planes, Vector=multiplication_2)

panel_4 = Panel(contact_zones.zones)

# ----
# FABRICATION TOOLPATH
number_slider_9 = Slider(2, range=0..10)
toggle_3 = BooleanToggle(True)
generate_toolpath = IronPython2Script(
    run=Toggle(True),
    model=add_sunrise_joint.model,
    plates_id=Slider(0, range=0..100),
    contour_tool_radius=Slider(10, range=0..10),
    holes_tool_radius=number_slider_9,
    notch=Toggle(True),
    cylinder=toggle_3,
    tbone=toggle_3)  # -> model, top_milling_contour, bottom_milling_contour, top_milling_holes, bottom_milling_holes; inputs run: Boolean, plates_id: list of String, contour_tool_radius: Double, holes_tool_radius: Double, notch: Boolean, cylinder: Boolean, limit: Double, tbone: Boolean, switch: list of Int32
#   port run: Generate toolpath if run is True.
#   port plates_id: (Optional) List of plates to only merge joints for those plates.
#   port contour_tool_radius: Radius of tool used to cut the contour.
#   port holes_tool_radius: Radius of tool used to cut the holes.
#   port notch: Generate notches in corners for insertion.
#   port cylinder: If notch is True, generate cylinders as joints_negatives for detailed vizualization of the notches.
#   port limit: (optional) Limit the angle of the corners for which a notch should be created.
#   port tbone: Change notch style: Dog-bone if False, T-bone if True.
#   port switch: (optional) List of plates for which the top and bottom planes should be switched.
#   port model: Updated plate model.
#   port top_milling_contour: Top polyline for contour milling toolpath.
#   port bottom_milling_contour: Bottom polyline for contour milling toolpath.
#   port top_milling_holes: Top polyline for holes milling toolpath.
#   port bottom_milling_holes: Bottom polyline for holes milling toolpath.
# ---------- generate_toolpath: IronPython ----------
__author__ = "Nicolas Rogeau"
__laboratory__ = "IBOIS, Laboratory for Timber Construction" 
__university__ = "EPFL, Ecole Polytechnique Federale de Lausanne"
__funding__ = "NCCR Digital Fabrication"
__version__ = "2024.08"
__license__ = "MIT License"
__repository__ = "https://github.com/nrogeau/Manis-timber-plate-joinery-solver"
__reference__ = "https://doi.org/10.1016/j.autcon.2021.103875"

import copy
import Grasshopper.Kernel as gh
import platesjoineryR8 as pj 
reload(pj)

if model:
    if run is True or run == None:
        model = copy.deepcopy(model)
        model.get_fabrication_lines(plates_id, contour_tool_radius, holes_tool_radius, notch, cylinder, limit, tbone)
        model.switch_top_bottom(switch)

        top_milling_contour =  [[plate.top_milling_contour] for plate in model.plates]
        bottom_milling_contour  = [[plate.bottom_milling_contour]  for plate in model.plates]
        top_milling_holes =  [plate.top_milling_holes for plate in model.plates]
        bottom_milling_holes  = [plate.bottom_milling_holes for plate in model.plates]
        top_milling_contour = pj.Toolbox.Data.list_to_datatree(top_milling_contour)
        bottom_milling_contour = pj.Toolbox.Data.list_to_datatree(bottom_milling_contour)
        top_milling_holes = pj.Toolbox.Data.list_to_datatree(top_milling_holes)
        bottom_milling_holes = pj.Toolbox.Data.list_to_datatree(bottom_milling_holes)
else:
    ghenv.Component.AddRuntimeMessage(gh.GH_RuntimeMessageLevel.Warning, "Waiting to get a model as input.")
# ---------- end generate_toolpath ----------
plate_toolpath = IronPython2Script(model=generate_toolpath.model)  # -> top_milling_contour, bottom_milling_contour, top_milling_holes, bottom_milling_holes
#   port top_milling_contour: Top polyline for contour milling toolpath.
#   port bottom_milling_contour: Bottom polyline for contour milling toolpath.
#   port top_milling_holes: Top polyline for holes milling toolpath.
#   port bottom_milling_holes: Bottom polyline for holes milling toolpath.
# ---------- plate_toolpath: IronPython ----------
__author__ = "Nicolas Rogeau"
__laboratory__ = "IBOIS, Laboratory for Timber Construction" 
__university__ = "EPFL, Ecole Polytechnique Federale de Lausanne"
__funding__ = "NCCR Digital Fabrication"
__version__ = "2024.08"
__license__ = "MIT License"
__repository__ = "https://github.com/nrogeau/Manis-timber-plate-joinery-solver"
__reference__ = "https://doi.org/10.1016/j.autcon.2021.103875"

import Grasshopper.Kernel as gh
import platesjoineryR8 as pj 
reload(pj)

if model:
    top_milling_contour = [plate.top_milling_contour for plate in model.plates]
    bottom_milling_contour = [plate.bottom_milling_contour for plate in model.plates]
    top_milling_holes = [plate.top_milling_holes for plate in model.plates]
    bottom_milling_holes = [plate.bottom_milling_holes for plate in model.plates]
    top_milling_holes = pj.Toolbox.Data.list_to_datatree(top_milling_holes)
    bottom_milling_holes = pj.Toolbox.Data.list_to_datatree(bottom_milling_holes)
else:
    ghenv.Component.AddRuntimeMessage(gh.GH_RuntimeMessageLevel.Warning, "Waiting to get a model as input.")
# ---------- end plate_toolpath ----------

# ----
# BOOLEAN
number_slider_10 = Slider(0.1, range=0..0.1)
merge_joints = IronPython2Script(run=True, model=generate_toolpath.model, boolean_tol=number_slider_10, merge_tol=Slider(0.001, range=0..0.001))  # -> model, breps, log; inputs run: Boolean, plates_ids: list of Int32, boolean_tol: Double, merge_tol: Double
#   port run: Run solver if True.
#   port plates_ids: (Optional) List of plates to only merge joints for those plates.
#   port boolean_tol: (Optional) Adjust the tolerance for boolean operations.
#   port merge_tol: (Optional) Adjust the tolerance for merging coplanar faces.
#   port breps: List of merged breps.
#   port log: Message from solver.
# ---------- merge_joints: IronPython ----------
"""Build a plate model"""

import copy
import Grasshopper.Kernel as gh
import platesjoineryR8 as pj
reload(pj)


if model:
    if run is True or run == None:
        if boolean_tol == 0.0: boolean_tol = 0.1
        if merge_tol == 0.0: boolean_tol = 0.1
        model = copy.deepcopy(model)
        model.perform_boolean_operations(plates_ids, boolean_tol, merge_tol)
        breps = []
        for i in range(model.count):
            breps.append(model.plates[i].brep)
else:
    ghenv.Component.AddRuntimeMessage(gh.GH_RuntimeMessageLevel.Warning, "Waiting to get a model as input.")
# ---------- end merge_joints ----------
sequence_2 = DisplaySequence(breps=merge_joints.breps)

# ----
# TRANSFORM
crv = Curve(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)
crv_2 = Curve(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)
pln = Plane(Plane(origin=(-704.9160403, 703.2977737, 0), x=(0, -1, 0), y=(1, 0, 0)))
pln_2 = Plane(crv)
pln_3 = Plane(crv_2)
vec = Vector(Vector(2000, 0, 0))
dispatch_model = IronPython2Script(model=merge_joints.model, plane=pln_3, step=vec)  # -> model, breps; inputs plane: Plane, step: Vector3d, flip: list of String, custom: list of Point3d
#   port plane: Array location and orientation.
#   port step: Step between two plates as vector.
#   port flip: (Optional) List of plates to flip.
#   port custom: (Optional) Custom list of points to use for the array.
#   port model: Transformed plate model.
#   port breps: Transformed breps.
# ---------- dispatch_model: IronPython ----------
__author__ = "Nicolas Rogeau"
__laboratory__ = "IBOIS, Laboratory for Timber Construction" 
__university__ = "EPFL, Ecole Polytechnique Federale de Lausanne"
__funding__ = "NCCR Digital Fabrication"
__version__ = "2024.08"
__license__ = "MIT License"
__repository__ = "https://github.com/nrogeau/Manis-timber-plate-joinery-solver"
__reference__ = "https://doi.org/10.1016/j.autcon.2021.103875"

import copy
import Rhino.Geometry as rg
import Grasshopper.Kernel as gh
import platesjoineryR8 as pj
reload(pj)

if model:
    model = copy.deepcopy(model)
    if step.Length == 0: step = rg.Vector3d(1,0,0)
    if custom: transform_type = "Custom"
    else : transform_type = "Array"
    model.transform(transform_type, plane, step, flip, custom)
    breps = []
    for i in range(model.count):
        breps.append(model.plates[i].brep)

else:
    ghenv.Component.AddRuntimeMessage(gh.GH_RuntimeMessageLevel.Warning, "Waiting to get a model as input.")
# ---------- end dispatch_model ----------
orient_model = IronPython2Script(model=merge_joints.model, origin=pln, target=pln_2)  # -> model, breps; inputs origin: Plane, target: Plane
#   port origin: Plane of reference.
#   port target: Target plane.
#   port model: Transformed plate model.
#   port breps: Transformed breps.
# ---------- orient_model: IronPython ----------
__author__ = "Nicolas Rogeau"
__laboratory__ = "IBOIS, Laboratory for Timber Construction" 
__university__ = "EPFL, Ecole Polytechnique Federale de Lausanne"
__funding__ = "NCCR Digital Fabrication"
__version__ = "2024.08"
__license__ = "MIT License"
__repository__ = "https://github.com/nrogeau/Manis-timber-plate-joinery-solver"
__reference__ = "https://doi.org/10.1016/j.autcon.2021.103875"

import copy
import rhinoscriptsyntax as rs
import Grasshopper.Kernel as gh
import platesjoineryR8 as pj
reload(pj)

if model:
    model = copy.deepcopy(model)
    if origin == None : origin = rs.PlaneFromFrame((0,0,0), (1,0,0), (0,1,0))
    if target == None : target = rs.PlaneFromFrame((0,0,0), (1,0,0), (0,1,0))
    model.transform(mode = 'Orient', origin = origin, target = target)
    breps = []
    for i in range(model.count):
        breps.append(model.plates[i].brep)
else:
    ghenv.Component.AddRuntimeMessage(gh.GH_RuntimeMessageLevel.Warning, "Waiting to get a model as input.")
# ---------- end orient_model ----------
scale_model = IronPython2Script(model=merge_joints.model, origin=pln_3, factor=Slider(5, range=0..10))  # -> model, breps; inputs origin: Point3d, factor: Double
#   port origin: Reference point.
#   port factor: Scale factor.
#   port model: Transformed plate model.
#   port breps: Transformed breps.
# ---------- scale_model: IronPython ----------
__author__ = "Nicolas Rogeau"
__laboratory__ = "IBOIS, Laboratory for Timber Construction" 
__university__ = "EPFL, Ecole Polytechnique Federale de Lausanne"
__funding__ = "NCCR Digital Fabrication"
__version__ = "2024.08"
__license__ = "MIT License"
__repository__ = "https://github.com/nrogeau/Manis-timber-plate-joinery-solver"
__reference__ = "https://doi.org/10.1016/j.autcon.2021.103875"

import copy
import Rhino.Geometry as rg
import Grasshopper.Kernel as gh
import platesjoineryR8 as pj
reload(pj)

if model:
    model = copy.deepcopy(model)
    origin = rg.Plane(origin, rg.Vector3d(1,0,0), rg.Vector3d(0,1,0))
    model.transform(mode = 'Scale', origin = origin, scale = factor)
    breps = []
    for i in range(model.count):
        breps.append(model.plates[i].brep)

else:
    ghenv.Component.AddRuntimeMessage(gh.GH_RuntimeMessageLevel.Warning, "Waiting to get a model as input.")
# ---------- end scale_model ----------
stack_model = IronPython2Script(model=merge_joints.model, plane=pln_3)  # -> model, breps; inputs plane: Plane, flip: list of String
#   port plane: Stack location and orientation.
#   port flip: (Optional) List of plates to flip.
#   port model: Transformed plate model.
#   port breps: Transformed breps.
# ---------- stack_model: IronPython ----------
__author__ = "Nicolas Rogeau"
__laboratory__ = "IBOIS, Laboratory for Timber Construction" 
__university__ = "EPFL, Ecole Polytechnique Federale de Lausanne"
__funding__ = "NCCR Digital Fabrication"
__version__ = "2024.08"
__license__ = "MIT License"
__repository__ = "https://github.com/nrogeau/Manis-timber-plate-joinery-solver"
__reference__ = "https://doi.org/10.1016/j.autcon.2021.103875"

import copy
import Rhino.Geometry as rg
import Grasshopper.Kernel as gh
import platesjoineryR8 as pj
reload(pj)

if model:
    model = copy.deepcopy(model)
    model.transform('Stack', plane, None, flip, None)
    breps = []
    for i in range(model.count):
        breps.append(model.plates[i].brep)

else:
    ghenv.Component.AddRuntimeMessage(gh.GH_RuntimeMessageLevel.Warning, "Waiting to get a model as input.")
# ---------- end stack_model ----------
sequence_3 = DisplaySequence(breps=orient_model.breps)
sequence_4 = DisplaySequence(breps=stack_model.breps)

# ----
# ROBOTICS
number_slider_11 = Slider(1, range=0..100)
number_slider_12 = Slider(300, range=0..1000)
crv_3 = Curve(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)
pln_4 = Plane(crv_3)
robot_trajectory = IronPython2Script(
    stack_module=stack_model.model,
    goal_module=orient_model.model,
    plates_id=number_slider_11,
    safe_spot=pln_4,
    up_dist=number_slider_12,
    retreat_dist=number_slider_12)  # -> planes; inputs plates_id: list of String, safe_spot: Plane, up_dist: Double, retreat_dist: Double
#   port stack_module: The plate module stacked in range of the robotic arm.
#   port goal_module: The plate module to assemble in range of the robotic arm.
#   port plates_id: (Optional) List of plates to assemble with a robot.
#   port safe_spot: A plane where the robot can safely move between the assembly of each plate.
#   port up_dist: The distance above the assembly where the robot should travel.
#   port retreat_dist: The distance that the robot should travel to retreat after the insertion of the plate.
#   port planes: The list of planes for the robot trajectory.
# ---------- robot_trajectory: IronPython ----------
__author__ = "Nicolas Rogeau"
__laboratory__ = "IBOIS, Laboratory for Timber Construction" 
__university__ = "EPFL, Ecole Polytechnique Federale de Lausanne"
__funding__ = "NCCR Digital Fabrication"
__version__ = "2024.08"
__license__ = "MIT License"
__repository__ = "https://github.com/nrogeau/Manis-timber-plate-joinery-solver"
__reference__ = "https://doi.org/10.1016/j.autcon.2021.103875"

import Grasshopper.Kernel as gh
import rhinoscriptsyntax as rs
import platesjoineryR8 as pj
reload(pj)
planes = None

if goal_module and stack_module:

    #default param
    if safe_spot is None: safe_spot = rs.PlaneFromNormal((1230,-1350,2020),(0,0,1))
    if up_dist is None or up_dist==0: up_dist = 100
    if retreat_dist is None or retreat_dist==0: retreat_dist = 10

    # initialization
    planes = []
    bases = []
    goals = []
    normals = []
    foam_dist = 20 # foam height on Joulin

    #auto-flip plates in stack
    for i in range(goal_module.count):
        if stack_module.plates[i].top_center[2] < stack_module.plates[i].bottom_center[2] :
            bases.append(stack_module.plates[i].bottom_plane)
            goals.append(goal_module.plates[i].bottom_plane)
            normals.append(goal_module.plates[i].bottom_normal)
        else :
            bases.append(stack_module.plates[i].top_plane)
            goals.append(goal_module.plates[i].top_plane)
            normals.append(goal_module.plates[i].top_normal)

    if len(bases) != len(goals):
        self.AddRuntimeMessage(Grasshopper.Kernel.GH_RuntimeMessageLevel.Error, 'start and goal model should have the same number of plates') 

    # plane and text list
    else:
        for i in range(goal_module.count):
            flag = True
            if (plates_id != []) and (plates_id != 'all') and (plates_id != None):
                flag = False
                for j in range(len(plates_id)):
                    if str(i) == plates_id[j]: flag = True
            if flag == True:

                #-------------------- SAFE PART (World) --------------------
    
                # safe_spot
                planes.append(safe_spot)
    
                #-------------------- BASE PART (model) --------------------
    
                # above_base
                above_base_point = rs.CopyObject(bases[i].Origin, (0,0,up_dist))
                above_base_plane = rs.PlaneFromFrame(above_base_point, bases[i].XAxis, bases[i].YAxis)
                planes.append(above_base_plane)
    
                # near_base
                near_base_point = rs.CopyObject(bases[i].Origin, (0,0,retreat_dist))
                near_base_plane = rs.PlaneFromFrame(near_base_point, bases[i].XAxis, bases[i].YAxis)
                planes.append(near_base_plane)
    
                #------------------- BASE PART (picture) -------------------
    
                # near_base
                planes.append(near_base_plane)
    
                # to_plate
                to_plate_point = rs.CopyObject(bases[i].Origin, (0,0, foam_dist))
                to_plate_plane = rs.PlaneFromFrame(to_plate_point, bases[i].XAxis, bases[i].YAxis)
                planes.append(to_plate_plane)
    
                # near_base
                planes.append(near_base_plane)
    
                # above_base
                planes.append(above_base_plane)
    
                #-------------------- SAFE PART (World) --------------------
    
                # safe_spot
                planes.append(safe_spot)
    
                #------------------- GOAL PART (picture) -------------------
                
                # above_goal
                if goal_module.assembly_vectors[i] == 'gravity': 
                    near_goal_point = rs.CopyObject(goals[i].Origin, -retreat_dist * rs.VectorCreate((0,0,-1),(0,0,0)))
                else: near_goal_point = rs.CopyObject(goals[i].Origin, -retreat_dist * goal_module.assembly_vectors[i])
                above_goal_point = rs.CopyObject(near_goal_point, (0,0,up_dist))
                above_goal_plane = rs.PlaneFromFrame(above_goal_point, goals[i].XAxis,goals[i].YAxis)
                planes.append(above_goal_plane)
    
                # near_goal
                near_goal_plane = rs.PlaneFromFrame(near_goal_point, goals[i].XAxis,goals[i].YAxis)
                planes.append(near_goal_plane)
    
    
                # to_insert
                planes.append(goals[i])
    
                # retreat
                retreat_point = rs.CopyObject(goals[i].Origin, retreat_dist * normals[i])
                retreat_plane = rs.PlaneFromFrame(retreat_point, goals[i].XAxis, goals[i].YAxis)
                planes.append(retreat_plane)
    
                # above_retreat
                above_retreat = rs.CopyObject(retreat_point, (0,0,up_dist))
                retreat_plane = rs.PlaneFromFrame(above_retreat, goals[i].XAxis, goals[i].YAxis)
                planes.append(retreat_plane)
# ---------- end robot_trajectory ----------
robosim = RobotSimulation(progression=Slider(0.78, range=0..1), planes=robot_trajectory)  # -> end_effector_tcp, current_step
display_trajectory = DisplayTrajectory(planes=robot_trajectory)
plate_simulation = IronPython2Script(
    stack_module=stack_model.model,
    goal_module=orient_model.model,
    plates_id=number_slider_11,
    planes=robot_trajectory,
    tcp=robosim.end_effector_tcp,
    current_step=robosim.current_step)  # -> breps; inputs plates_id: list of String, planes: list of Plane, tcp: Plane, current_step: Int32, pick_step: Int32, drop_step: Int32
#   port stack_module: The plate module stacked in range of the robotic arm.
#   port goal_module: The plate module to assemble in range of the robotic arm.
#   port planes: The list of planes describing the trajectory of the robotic arm.
#   port current_step: The current step for the assembly.
#   port pick_step: The step where the robot should pick the plate.
#   port drop_step: The step where the robot should drop the plate.
#   port breps: Plates displayed according to robot movements.
# ---------- plate_simulation: IronPython ----------
__author__ = "Nicolas Rogeau"
__laboratory__ = "IBOIS, Laboratory for Timber Construction" 
__university__ = "EPFL, Ecole Polytechnique Federale de Lausanne"
__funding__ = "NCCR Digital Fabrication"
__version__ = "2024.08"
__license__ = "MIT License"
__repository__ = "https://github.com/nrogeau/Manis-timber-plate-joinery-solver"
__reference__ = "https://doi.org/10.1016/j.autcon.2021.103875"

import Grasshopper.Kernel as gh
import platesjoineryR8 as pj
import Rhino.Geometry as rg
import rhinoscriptsyntax as rs 
reload(pj)

if current_step is None: current_step = 0
if pick_step is None or pick_step==0: pick_step = 6
if drop_step is None or drop_step==0: drop_step = 11


display = []

if goal_module and stack_module:
    goal = []
    stack = []
    for i in range(goal_module.count):
        flag = True
        if (plates_id != []) and (plates_id != 'all') and (plates_id != None):
            flag = False
            for j in range(len(plates_id)):
                if str(i) == plates_id[j]: flag = True
        if flag is True:
            goal.append(goal_module.plates[i].brep)
            stack.append(stack_module.plates[i].brep)

if stack_module and goal_module and planes and tcp:
    #number of moves
    n = int(len(planes)/len(stack))
    # beginning phase
    if current_step < pick_step :
        display = stack
    
    # on move phase
    elif (current_step % n >= pick_step) and (current_step % n <= drop_step):
        plate_on_move = (current_step - current_step % n) / n
        for i in range(len(stack)):
            if i < plate_on_move: display.append(goal[i])
            if i == plate_on_move:
                start_plane = planes[current_step - current_step % n + pick_step-2]
                matrix = rg.Transform.PlaneToPlane(start_plane, tcp)
                obj = rs.TransformObject(rs.CopyObject(stack[i]), matrix)
                display.append(obj)
            if i > plate_on_move: display.append(stack[i])
    
    # stand still phase
    else:
        current_step = current_step - pick_step
        plate_on_move = (current_step - current_step % n) / n
        for i in range(len(stack)):
            if i <= plate_on_move: display.append(goal[i])
            if i > plate_on_move: display.append(stack[i])
    breps = display
# ---------- end plate_simulation ----------

# ==== cluster DisplaySequence: Display a colorful assembly sequence.
breps = ClusterInput()  # Plate as Brep

# ---- group: Brep
dom = ConstructDomain(DomainStart=Slider(0, range=0..1), DomainEnd=Slider(0.3, range=0..1))
lng = ListLength(List=breps)
range = Range(Domain=dom, Steps=lng)
hsl = ColourHSL(Alpha=Slider(0.14, range=0..1), Hue=range, Saturation=Slider(1, range=0..1), Luminance=Slider(0.5, range=0..1))
preview = CustomPreview(Geometry=breps, Material=hsl)

# ---- group: Text
area = Area(Geometry=breps)  # -> Area, Centroid
index = ItemIndex(List=breps, Item=breps)
pl = ConstructPlane(Origin=area.Centroid, XAxis=Vector(1, 0, 0), YAxis=Vector(0, 0, 1))
sqrt = SquareRoot(Value=area.Area)
division = Division(A=sqrt, B=10)
tag = TextTag3D(Location=pl, Text=index, Size=division, Colour=hsl, Justification=5)

# ----
swatch = ColourSwatch(SwatchColor=RGB(0, 0, 0))

# ==== cluster DisplayTrajectory: Display robot trajectory
planes = ClusterInput()
pline = PolyLine(Vertices=planes, Closed=False)
dash = Dash(curve=pline, dash_size=Slider(20, range=0..20))
preview = CustomPreview(Geometry=dash, Material=ColourSwatch(SwatchColor=RGB(150, 250, 50)))

# ==== cluster RobotSimulation: Open cluster to edit TCP parameters. (Requires the installation of Robots plugin)
list = RobotsLibrary({"IBOIS-IRB6400"}, selected="IBOIS-IRB6400", Type=0)

M = Mesh(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)
load_robot = LoadRobotSystem(Name=list, Base=PlaneXY(0, 0, 517))
tool = CreateTool(
    Name="Gripper",
    TCP=Plane(origin=(-0.508434811, 4.981788, 282.9849136), x=(0.002205531405, 0.9999627875, -0.008340218136), y=(0.9999946005, -0.002185130368, 0.002454425213)),
    Weight=0,
    Mesh=M)  # -> Tool, TCP
tool_2 = Data(tool.Tool)
degtorad = DegreesToRadians(Degrees=[0, 0, 0, 0, 0, 0], RobotSystem=load_robot, MechanicalGroup=0)
list_2 = ValueList({"Joint", "Linear"}, selected="Joint")
planes = ClusterInput()
target = CreateTarget(Joints=degtorad, Tool=tool_2, IsCartesian=False)
target_2 = CreateTarget(Plane=planes, Motion=list_2, Tool=tool_2, IsCartesian=True)

merge = Merge(Data1=flatten(target), Data2=flatten(target_2))  # -> flatten(Result)
program = CreateProgram(Name="DefaultProgram", RobotSystem=load_robot, Targets1=merge, StepSize=1)  # -> Program, flatten(Code), Duration, Warnings, Errors
progression = ClusterInput()
sim = ProgramSimulation(Program=program.Program, Time=progression, Normalized=True)  # -> SystemMeshes, JointRotations, Plane, Index, Time, Program, Errors
item = ListItem(List=sim.Plane, Index=-1, Wrap=True)
current_step = ClusterOutput(sim.Index)
pln = Plane(item)
end_effector_tcp = ClusterOutput(pln)

lng = ListLength(List=program.Errors)
brep = Brep(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)
dispatch = Dispatch(List=[brep, sim.SystemMeshes], DispatchPattern=lng)  # -> ListA, ListB
preview = CustomPreview(Geometry=dispatch.ListB, Material=ColourSwatch(SwatchColor=RGBA(100, 150, 150, 150)))
preview_2 = CustomPreview(Geometry=dispatch.ListA, Material=ColourSwatch(SwatchColor=RGBA(200, 150, 150, 150)))

# ==== cluster Dash
curve = ClusterInput()
dash_size = ClusterInput()
len = Length(Curve=curve)
division = Division(A=len, B=dash_size)
divide = DivideCurve(Curve=curve, Count=division, Kinks=True)  # -> Points, Tangents, Parameters
shift = ShiftList(List=divide.Points, Shift=1, Wrap=False)
ln = Line(StartPoint=divide.Points, EndPoint=shift)
cull = CullPattern(List=ln, CullPattern=[False, True])
crv = Curve(cull)
dashed_line = ClusterOutput(crv)
