# Grasshopper definition example_file_barn.gh (Grasshopper 1.0.8)
# plug-ins: RhinoCodePluginGH

# ----
# Inputs:
# -Ordered list of breps
# -Assembly sequence
panel = Panel("[[[20,21],6,7,12,13],[[22,23],8,9,14,15],[[18,19],10,11,16,17],3,0,2,4,1,5]")
brep = Brep([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])

build_plate_model = BuildPlateModel(run=True, breps=brep, sequence=panel)  # -> model, breps, sequence, log; inputs run: Boolean, breps: list of Brep, sequence: String, constraints: tree, discard: list of String
#   port run: Run solver if True.
#   port breps: List of breps following the order of the assembly sequence.
#   port sequence: Order of assembly of the plates (supports modular assembly logic). String format: "[0,2,3,[4,1],5]" (where each "[x]" is a module).
#   port constraints: Geometric constraints for each contact type. (Use "constraints" component)
#   port discard: List of pairs of plates to discard. Format: "(a,b)" = Discard contact between plates a and b.
#   port breps: List of re-ordered Breps.
#   port sequence: Re-ordered sequence.
#   port log: Message from solver.
# ---------- build_plate_model: Python ----------
__author__ = "Nicolas Rogeau"
__laboratory__ = "IBOIS, Laboratory for Timber Construction" 
__university__ = "EPFL, Ecole Polytechnique Federale de Lausanne"
__funding__ = "NCCR Digital Fabrication"
__version__ = "2024.08"
__license__ = "MIT License"
__repository__ = "https://github.com/nrogeau/Manis-timber-plate-joinery-solver"
__reference__ = "https://doi.org/10.1016/j.autcon.2021.103875"

import Grasshopper.Kernel as gh
import platesjoineryR8 as pj
reload(pj)

model = None
log = None
if breps:
    if run is True or run == None:
        if sequence is None:
            model = pj.PlateModel(breps,constraints=constraints,discard=[])
        else: model = pj.PlateModel(breps, sequence, constraints=constraints,discard=[])
        if model.count < len(breps): ghenv.Component.AddRuntimeMessage(gh.GH_RuntimeMessageLevel.Warning, "The provided sequence does not include all referenced breps.")
        breps = model.breps
        sequence = model.sequence
        log = model.log
else:
    ghenv.Component.AddRuntimeMessage(gh.GH_RuntimeMessageLevel.Warning, "Waiting to get breps as input.")
# ---------- end build_plate_model ----------
trigger = Trigger(Interval=50, TimerInterval=50, Target=sequence)
sequence = DisplaySequence(breps=build_plate_model.breps)

# ----
# Create joints
add_half_lap_joint = AddHalfLapJoint(model=build_plate_model.model)  # -> model, joints_positives, joints_negatives, joints_keys; inputs plates_pairs: list of String, proportion: Double, tolerance: Double, min_angle: Double, straight_height: Double, fillet_height: Double, segments: Int32
#   port plates_pairs: (Optional) List of pair of plates (a,b) to only add joints between those plates.
#   port proportion: The proportion of the cut (default halflap = 0.5) between both pieces.
#   port tolerance: Chamfer the halflap joint to add more tolerance for assembly.
#   port min_angle: If joint with tolerance: minimum angle for the slope of the optional chamfer (usually around 45 degrees)."
#   port straight_height: If joint with tolerance: size of the part of the notch without chamfer.
#   port fillet_height: If joint with tolerance: size of the rounded part of the notch.
#   port segments: If joint with tolerance: number of segments for the discretization of the opening curve.
#   port model: Updated plate model.
#   port joints_positives: The joints to add to each plate.
#   port joints_negatives: The joints to subtract from each plate.
#   port joints_keys: The keys to insert in each plate.
# ---------- add_half_lap_joint: Python ----------
__author__ = "Nicolas Rogeau"
__laboratory__ = "IBOIS, Laboratory for Timber Construction" 
__university__ = "EPFL, Ecole Polytechnique Federale de Lausanne"
__funding__ = "NCCR Digital Fabrication"
__version__ = "2024.08"
__license__ = "MIT License"
__repository__ = "https://github.com/nrogeau/Manis-timber-plate-joinery-solver"
__reference__ = "https://doi.org/10.1016/j.autcon.2021.103875"
import scriptcontext as sc
import copy
import Grasshopper.Kernel as gh
import platesjoineryR8 as pj 
reload(pj)
joints_positives = []
joints_negatives = []
joints_keys = []
if proportion == 0.0: proportion = 0.5
if model:
    model = copy.deepcopy(model)
    model.add_halflap(plates_pairs, 
        proportion,
        tolerance,
        min_angle,
        straight_height,
        fillet_height,
        segments)

    for plate in model.plates:
        joints_positives.append(plate.joints_positives)
        joints_negatives.append(plate.joints_negatives)
        joints_keys.append(plate.joints_keys)
    joints_positives = pj.Toolbox.Data.list_to_datatree(joints_positives)
    joints_negatives = pj.Toolbox.Data.list_to_datatree(joints_negatives)
    joints_keys = pj.Toolbox.Data.list_to_datatree(joints_keys)
else:
    ghenv.Component.AddRuntimeMessage(gh.GH_RuntimeMessageLevel.Warning, "Waiting to get a model as input.")
# ---------- end add_half_lap_joint ----------
add_dowel_joint = AddDowelJoint(
    model=add_half_lap_joint.model,
    dowel_number=Slider(5, range=0..10),
    dowel_radius=Slider(5, range=0..100),
    circle_radius=Slider(35, range=0..100),
    circle_rotation=Slider(18, range=0..100),
    dowel_angle_1=0,
    dowel_angle_2=0,
    parallel=False)  # -> model, joints_positives, joints_negatives, joints_keys; inputs plates_pairs: list of String, dowel_number: Int32, dowel_radius: Double, dowel_tolerance: Double, dowel_retreat_1: Double, dowel_retreat_2: Double, circle_radius: Double, circle_rotation: Double, dowel_angle_1: Double, dowel_angle_2: Double, parallel: Boolean, tile: Curve
#   port plates_pairs: (Optional) List of pair of plates (a,b) to only add joints between those plates.
#   port dowel_number: The number of dowels to create for each contact zones
#   port dowel_radius: The radius of the dowels.
#   port dowel_tolerance: The distance between the border of the hole and the dowel.
#   port dowel_retreat_1: The distance which separate the top of the surface of the first plate to one side of the dowel.
#   port dowel_retreat_2: The distance which separate the top of the surface of the second plate to the one side of the dowel.
#   port circle_radius: (In the case of several dowels) The radius of the circle on which the dowels are laying.
#   port circle_rotation: (In the case of several dowels) The rotation of the circle on which the dowels are laying.
#   port dowel_angle_1: The rotation of the dowel in the plane of the plate.
#   port dowel_angle_2: The rotation of the dowel through the plate.
#   port parallel: Align all dowels if True. Otherwise, the inclination of the dowels is directed towards the center of the joint.
#   port tile: (Optional) Geometric tile as polyline to customize the shape of the dowel. Tile should be drawn scale and centered on the world origin.
#   port model: Updated plate model.
#   port joints_positives: The joints to add to each plate.
#   port joints_negatives: The joints to subtract from each plate.
#   port joints_keys: The keys to insert in each plate.
# ---------- add_dowel_joint: Python ----------
__author__ = "Nicolas Rogeau"
__laboratory__ = "IBOIS, Laboratory for Timber Construction" 
__university__ = "EPFL, Ecole Polytechnique Federale de Lausanne"
__funding__ = "NCCR Digital Fabrication"
__version__ = "2024.08"
__license__ = "MIT License"
__repository__ = "https://github.com/nrogeau/Manis-timber-plate-joinery-solver"
__reference__ = "https://doi.org/10.1016/j.autcon.2021.103875"

import copy
import Grasshopper.Kernel as gh
import platesjoineryR8 as pj 
reload(pj)
        
joints_positives = []
joints_negatives = []
joints_keys = []

if model:
    model = copy.deepcopy(model)
    model.add_dowels(plates_pairs, 
        dowel_number,
        dowel_radius, 
        dowel_tolerance, 
        dowel_retreat_1, 
        dowel_retreat_2, 
        circle_radius, 
        circle_rotation, 
        dowel_angle_1,
        dowel_angle_2,
        parallel,
        tile)

    for plate in model.plates:
        joints_positives.append(plate.joints_positives)
        joints_negatives.append(plate.joints_negatives)
        joints_keys.append(plate.joints_keys)
    joints_positives = pj.Toolbox.Data.list_to_datatree(joints_positives)
    joints_negatives = pj.Toolbox.Data.list_to_datatree(joints_negatives)
    joints_keys = pj.Toolbox.Data.list_to_datatree(joints_keys)
else:
    ghenv.Component.AddRuntimeMessage(gh.GH_RuntimeMessageLevel.Warning, "Waiting to get a model as input.")
# ---------- end add_dowel_joint ----------
number_slider = Slider(20, range=0..100)
add_finger_joint = AddFingerJoint(
    model=add_dowel_joint.model,
    finger_number_2=Slider(3, range=0..10),
    finger_width_1=number_slider,
    finger_width_2=number_slider,
    finger_shift=Slider(-10, range=-10..0))  # -> model, joints_positives, joints_negatives, joints_keys; inputs plates_pairs: list of String, finger_number_1: Int32, finger_number_2: Int32, finger_length_1: Double, finger_length_2: Double, finger_width_1: Double, finger_width_2: Double, finger_spacing: Double, finger_shift: Double, mirror: Boolean
#   port plates_pairs: (Optional) List of pair of plates (a,b) to only add joints between those plates.
#   port finger_number_1: The number of fingers on the first side.
#   port finger_number_2: The number of fingers on the second side.
#   port finger_length_1: (Optional) The length of the fingers on the first side. Default value will fit plate thickness.
#   port finger_length_2: (Optional) The length of the fingers on the second side. Default value will fit plate thickness.
#   port finger_width_2: The width of the fingers on the second side.
#   port finger_spacing: The space between two fingers.
#   port finger_shift: (Optional) Shift the fingers from their central position.
#   port mirror: Mirror the joint.
#   port model: Updated plate model.
#   port joints_positives: The joints to add to each plate.
#   port joints_negatives: The joints to subtract from each plate.
#   port joints_keys: The keys to insert in each plate.
# ---------- add_finger_joint: Python ----------
__author__ = "Nicolas Rogeau"
__laboratory__ = "IBOIS, Laboratory for Timber Construction" 
__university__ = "EPFL, Ecole Polytechnique Federale de Lausanne"
__funding__ = "NCCR Digital Fabrication"
__version__ = "2024.08"
__license__ = "MIT License"
__repository__ = "https://github.com/nrogeau/Manis-timber-plate-joinery-solver"
__reference__ = "https://doi.org/10.1016/j.autcon.2021.103875"

import copy
import Grasshopper.Kernel as gh
import platesjoineryR8 as pj 
reload(pj)

joints_positives = []
joints_negatives = []
joints_keys = []

if model:
    model = copy.deepcopy(model)
    model.add_fingers(plates_pairs,
            finger_number_1,
            finger_length_1,
            finger_width_1,
            finger_number_2,
            finger_length_2,
            finger_width_2,
            finger_spacing,
            finger_shift,
            mirror)

    for plate in model.plates:
        joints_positives.append(plate.joints_positives)
        joints_negatives.append(plate.joints_negatives)
        joints_keys.append(plate.joints_keys)
    joints_positives = pj.Toolbox.Data.list_to_datatree(joints_positives)
    joints_negatives = pj.Toolbox.Data.list_to_datatree(joints_negatives)
    joints_keys = pj.Toolbox.Data.list_to_datatree(joints_keys)
else:
    ghenv.Component.AddRuntimeMessage(gh.GH_RuntimeMessageLevel.Warning, "Waiting to get a model as input.")
# ---------- end add_finger_joint ----------

merge_joints = MergeJoints(run=True, model=add_finger_joint.model)  # -> model, breps, log; inputs run: Boolean, plates_ids: list of Int32, boolean_tol: Double, merge_tol: Double
#   port run: Run solver if True.
#   port plates_ids: (Optional) List of plates to only merge joints for those plates.
#   port boolean_tol: (Optional) Adjust the tolerance for boolean operations.
#   port merge_tol: (Optional) Adjust the tolerance for merging coplanar faces.
#   port breps: List of merged breps.
#   port log: Message from solver.
# ---------- merge_joints: Python ----------
"""Build a plate model"""

import copy
import Grasshopper.Kernel as gh
import platesjoineryR8 as pj
reload(pj)


if model:
    if run is True or run == None:
        if boolean_tol == 0.0: boolean_tol = 0.1
        if merge_tol == 0.0: boolean_tol = 0.1
        model = copy.deepcopy(model)
        model.perform_boolean_operations(plates_ids, boolean_tol, merge_tol)
        breps = []
        for i in range(model.count):
            breps.append(model.plates[i].brep)
else:
    ghenv.Component.AddRuntimeMessage(gh.GH_RuntimeMessageLevel.Warning, "Waiting to get a model as input.")
# ---------- end merge_joints ----------

# ----
# Animate assembly sequence
# Slide to go through
# the assembly sequence
number_slider_2 = Slider(0, range=0..6.99)
split_decimal = SplitDecimal(num=number_slider_2)  # -> integer, decimal; inputs num: Double
#   port integer: Integer part.
#   port decimal: Decimal part.
# ---------- split_decimal: Python ----------
__author__ = "Nicolas Rogeau"
__laboratory__ = "IBOIS, Laboratory for Timber Construction" 
__university__ = "EPFL, Ecole Polytechnique Federale de Lausanne"
__funding__ = "NCCR Digital Fabrication"
__version__ = "2024.08"
__license__ = "MIT License"
__repository__ = "https://github.com/nrogeau/Manis-timber-plate-joinery-solver"
__reference__ = "https://doi.org/10.1016/j.autcon.2021.103875"

if num is not None:             
    st = str(num).split(".")
    integer = int(st[0])
    decimal = float("0."+st[1])
# ---------- end split_decimal ----------
get_modules = GetModules(model=merge_joints.model, module_id=split_decimal.integer)  # -> module, sequence, step; inputs module_id: Int32
#   port module: Module(s) inheriting model functions.
#   port sequence: Sub-sequence of the module.
#   port step: Tag representing the position of the module in the full assembly sequence. 'M' stands for the final step of the Model.
# ---------- get_modules: Python ----------
__author__ = "Nicolas Rogeau"
__laboratory__ = "IBOIS, Laboratory for Timber Construction" 
__university__ = "EPFL, Ecole Polytechnique Federale de Lausanne"
__funding__ = "NCCR Digital Fabrication"
__version__ = "2024.08"
__license__ = "MIT License"
__repository__ = "https://github.com/nrogeau/Manis-timber-plate-joinery-solver"
__reference__ = "https://doi.org/10.1016/j.autcon.2021.103875"

import rhinoscriptsyntax as rs
import Grasshopper.Kernel as gh
import platesjoineryR8 as pj
reload(pj)

if model:
    if module_id != None:
        module_id = module_id % len(model.modules)
        module = model.modules[module_id]
        breps = model.modules[module_id].breps
        step = str(model.modules[module_id].step)
        sequence = str(model.modules[module_id].sequence)
        assembly_vectors = []
        for i in range(len(model.modules[module_id].assembly_vectors)):
            vector = model.modules[module_id].assembly_vectors[i]
            if vector == "gravity": vector = rs.VectorCreate((0,0,-1),(0,0,0))
            assembly_vectors.append(pj.Toolbox.Vectors.round_vector(vector,6))
    else:
        module = []
        breps = []
        sequence = []
        step = []
        assembly_vectors = []
        for mod in model.modules:
            module.append(mod)
            breps.append(mod.breps)
            sequence.append(str(mod.sequence))
            step.append(str(mod.step))
            sub_assembly_vectors = []
            for vec in mod.assembly_vectors:
                if vec == "gravity": vec = rs.VectorCreate((0,0,-1),(0,0,0))
                sub_assembly_vectors.append(pj.Toolbox.Vectors.round_vector(vec,6))
            assembly_vectors.append(sub_assembly_vectors)
        breps = pj.Toolbox.Data.list_to_datatree(breps)
        assembly_vectors = pj.Toolbox.Data.list_to_datatree(assembly_vectors)
else:
    ghenv.Component.AddRuntimeMessage(gh.GH_RuntimeMessageLevel.Warning, "Waiting to get a model as input.")
# ---------- end get_modules ----------
animate_assembly = AnimateAssembly(module=get_modules.module, progress=split_decimal.decimal, retreat=Slider(237, range=0..1000), hold=Toggle(True))  # -> breps, status; inputs progress: Double, retreat: Double, hold: Boolean
#   port module: Plate module or plate model.
#   port progress: Animation progression from 0 to 1.
#   port retreat: Length of the insertion path.
#   port hold: If True, plates will be held in place during half of the progress bar, which allow to display to final result. If False, the display will only show plates on the move.
#   port breps: Show breps in motion.
#   port status: Assembly progression.
# ---------- animate_assembly: Python ----------
__author__ = "Nicolas Rogeau"
__laboratory__ = "IBOIS, Laboratory for Timber Construction" 
__university__ = "EPFL, Ecole Polytechnique Federale de Lausanne"
__funding__ = "NCCR Digital Fabrication"
__version__ = "2024.08"
__license__ = "MIT License"
__repository__ = "https://github.com/nrogeau/Manis-timber-plate-joinery-solver"
__reference__ = "https://doi.org/10.1016/j.autcon.2021.103875"

import ast 
import rhinoscriptsyntax as rs
import Grasshopper.Kernel as gh
import platesjoineryR8 as pj
reload(pj)

if module:
    # If model as input, take last module for animation.
    if hasattr(module, 'model') is False:
        module = module.modules[-1]

    #start of insertion
    if progress == 0: 
        status = ('start of insertion sequence')
    else:
        vectors = module.assembly_vectors
        count = module.count
        seq = ast.literal_eval(module.sequence)
        breps = []
        progress = progress * count
        deci = progress - int(progress)

        # animation
        for i in range(count):
            if vectors[i] == "gravity": vectors[i] = rs.VectorCreate((0,0,-1),(0,0,0))
            # standing plates
            if i < int(progress) :
                plate_ids = pj.Toolbox.Data.flatten_integer_list(seq[i])
                if type(plate_ids) is list:
                    for integer in plate_ids:
                        breps.append(rs.CopyObject(module.model.plates[integer].brep))
                else: breps.append(rs.CopyObject(module.model.plates[plate_ids].brep))
            # moving plates
            if i == int(progress) :
                if type(seq[i]) is list:
                    plate_ids = pj.Toolbox.Data.flatten_integer_list(seq[i])
                    for integer in plate_ids:
                        if hold is False:
                            breps.append(rs.CopyObject(module.model.plates[integer].brep, -(1-deci)*retreat*vectors[i]))
                        else:
                            if deci >= 0.5: eff_deci = 1
                            else: eff_deci = 2*deci
                            breps.append(rs.CopyObject(module.model.plates[integer].brep, -(1-eff_deci)*retreat*vectors[i]))
                else: 
                    if hold is False:
                        breps.append(rs.CopyObject(module.model.plates[seq[i]].brep, -(1-deci)*retreat*vectors[i]))
                    else:
                        if deci >= 0.5: eff_deci = 1
                        else: eff_deci = 2*deci
                        breps.append(rs.CopyObject(module.model.plates[seq[i]].brep, -(1-eff_deci)*retreat*vectors[i]))

        # ongoing status
        perc = 100*(progress - int(progress))
        status = ('plate '+ str(int(progress)) + ' inserted at ' + str(perc)+ ' %.')

        # end status
        if progress == 1: status = ('end of insertion sequence')

    if breps is not None: 
        for i in range(len(breps)): breps[i]= rs.coercebrep(breps[i])
else:
    ghenv.Component.AddRuntimeMessage(gh.GH_RuntimeMessageLevel.Warning, "Waiting to get a module or model as input.")
# ---------- end animate_assembly ----------
panel_2 = Panel(animate_assembly.status)
geo = Geometry(animate_assembly.breps)

# ==== cluster DisplaySequence: Display a colorful assembly sequence.
breps = ClusterInput()  # Plate as Brep

# ---- group: Brep
dom = ConstructDomain(DomainStart=Slider(0, range=0..1), DomainEnd=Slider(0.3, range=0..1))
lng = ListLength(List=breps)
range = Range(Domain=dom, Steps=lng)
hsl = ColourHSL(Alpha=Slider(0, range=0..1), Hue=range, Saturation=Slider(1, range=0..1), Luminance=Slider(0.6, range=0..1))
preview = CustomPreview(Geometry=breps, Material=hsl)

# ---- group: Text
py3 = Python3Script(x=breps)  # -> out, screen_plane; inputs x: list
# ---------- py3: Python ----------
import Rhino
import Rhino.Geometry as rg

# Get the active Rhino viewport
viewport = Rhino.RhinoDoc.ActiveDoc.Views.ActiveView.ActiveViewport

# Camera position, target, and up vector
camera_location = viewport.CameraLocation
camera_target = viewport.CameraTarget
up_vector = viewport.CameraUp

# View direction (Z-axis of the screen)
view_direction = camera_target - camera_location
view_direction.Unitize()

# Right vector (X-axis of the screen) = Cross product of up vector and view direction
right_vector = rg.Vector3d.CrossProduct(up_vector, view_direction)
right_vector.Unitize()

# Recalculate the up vector (Y-axis of the screen) to ensure orthogonality
top_vector = rg.Vector3d.CrossProduct(view_direction, right_vector)
top_vector.Unitize()

# Create the plane
screen_plane = rg.Plane(camera_location, -right_vector, top_vector)
# ---------- end py3 ----------
area = Area(Geometry=breps)  # -> Area, Centroid
index = ItemIndex(List=breps, Item=breps)
vec2pt = Vector2Pt(PointA=py3.screen_plane, PointB=area.Centroid, Unitize=False)  # -> Vector, Length
sqrt = SquareRoot(Value=area.Area)
move = Move(Geometry=py3.screen_plane, Motion=vec2pt.Vector)  # -> Geometry, Transform
division = Division(A=sqrt, B=10)
tag = TextTag3D(Location=move.Geometry, Text=index, Size=division, Colour=ColourSwatch(SwatchColor=RGB(255, 255, 255)), Justification=5)
