# Grasshopper definition example_file_tutorial.gh (Grasshopper 1.0.8)
# plug-ins: RhinoCodePluginGH

brep = Brep([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])
build_plate_model = BuildPlateModel(run=True, breps=brep)  # -> model, breps, sequence, log; inputs run: Boolean, breps: list of Brep, sequence: String, constraints: tree, discard: list of String
#   port run: Run solver if True.
#   port breps: List of breps following the order of the assembly sequence.
#   port sequence: Order of assembly of the plates (supports modular assembly logic). String format: "[0,2,3,[4,1],5]" (where each "[x]" is a module).
#   port constraints: Geometric constraints for each contact type. (Use "constraints" component)
#   port discard: List of pairs of plates to discard. Format: "(a,b)" = Discard contact between plates a and b.
#   port breps: List of re-ordered Breps.
#   port sequence: Re-ordered sequence.
#   port log: Message from solver.
# ---------- build_plate_model: Python ----------
__author__ = "Nicolas Rogeau"
__laboratory__ = "IBOIS, Laboratory for Timber Construction" 
__university__ = "EPFL, Ecole Polytechnique Federale de Lausanne"
__funding__ = "NCCR Digital Fabrication"
__version__ = "2024.08"
__license__ = "MIT License"
__repository__ = "https://github.com/nrogeau/Manis-timber-plate-joinery-solver"
__reference__ = "https://doi.org/10.1016/j.autcon.2021.103875"

import Grasshopper.Kernel as gh
import platesjoineryR8 as pj
reload(pj)

model = None
log = None
if breps:
    if run is True or run == None:
        if sequence is None:
            model = pj.PlateModel(breps,constraints=constraints,discard=[])
        else: model = pj.PlateModel(breps, sequence, constraints=constraints,discard=[])
        if model.count < len(breps): ghenv.Component.AddRuntimeMessage(gh.GH_RuntimeMessageLevel.Warning, "The provided sequence does not include all referenced breps.")
        breps = model.breps
        sequence = model.sequence
        log = model.log
else:
    ghenv.Component.AddRuntimeMessage(gh.GH_RuntimeMessageLevel.Warning, "Waiting to get breps as input.")
# ---------- end build_plate_model ----------
sequence = DisplaySequence(breps=brep)
contact_neighbours = ContactNeighbours(model=build_plate_model.model)  # -> ids, pairs, neighbours
#   port ids: The list of neighbours IDs organized as a tree.
#   port pairs: The list of neighbours IDs organized by pairs.
#   port neighbours: Neighbours of each plate as Breps.
# ---------- contact_neighbours: Python ----------
__author__ = "Nicolas Rogeau"
__laboratory__ = "IBOIS, Laboratory for Timber Construction" 
__university__ = "EPFL, Ecole Polytechnique Federale de Lausanne"
__funding__ = "NCCR Digital Fabrication"
__version__ = "2024.08"
__license__ = "MIT License"
__repository__ = "https://github.com/nrogeau/Manis-timber-plate-joinery-solver"
__reference__ = "https://doi.org/10.1016/j.autcon.2021.103875"

import Grasshopper.Kernel as gh
import platesjoineryR8 as pj

if model:
    ids = pj.Toolbox.Data.list_to_datatree(model.contact_ids)
    pairs = pj.Toolbox.Data.list_to_datatree(model.contact_pairs)
    neighbours = pj.Toolbox.Data.list_to_datatree(model.contact_breps)
else:
    ghenv.Component.AddRuntimeMessage(gh.GH_RuntimeMessageLevel.Warning, "Waiting to get a model as input.")
# ---------- end contact_neighbours ----------
contact_types = ContactTypes(model=build_plate_model.model)  # -> types, strings
#   port types: Types of connections. (F=Face, S=Side, E=Edge, IN=Intersected).
#   port strings: Explicit description of the contact type.
# ---------- contact_types: Python ----------
__author__ = "Nicolas Rogeau"
__laboratory__ = "IBOIS, Laboratory for Timber Construction" 
__university__ = "EPFL, Ecole Polytechnique Federale de Lausanne"
__funding__ = "NCCR Digital Fabrication"
__version__ = "2024.08"
__license__ = "MIT License"
__repository__ = "https://github.com/nrogeau/Manis-timber-plate-joinery-solver"
__reference__ = "https://doi.org/10.1016/j.autcon.2021.103875"

import Grasshopper.Kernel as gh
import platesjoineryR8 as pj

if model:
    types = pj.Toolbox.Data.list_to_datatree(model.contact_types)
    strings = pj.Toolbox.Data.list_to_datatree(model.contact_strings)
else:
    ghenv.Component.AddRuntimeMessage(gh.GH_RuntimeMessageLevel.Warning, "Waiting to get a model as input.")
# ---------- end contact_types ----------
contact_zones = ContactZones(model=build_plate_model.model)  # -> zones, planes
#   port zones: Contact zone as surface.
#   port planes: Centered plane of the contact zone.
# ---------- contact_zones: Python ----------
__author__ = "Nicolas Rogeau"
__laboratory__ = "IBOIS, Laboratory for Timber Construction" 
__university__ = "EPFL, Ecole Polytechnique Federale de Lausanne"
__funding__ = "NCCR Digital Fabrication"
__version__ = "2024.08"
__license__ = "MIT License"
__repository__ = "https://github.com/nrogeau/Manis-timber-plate-joinery-solver"
__reference__ = "https://doi.org/10.1016/j.autcon.2021.103875"

import Grasshopper.Kernel as gh
import platesjoineryR8 as pj

if model:
    zones = pj.Toolbox.Data.list_to_datatree(model.contact_zones)
    planes = pj.Toolbox.Data.list_to_datatree(model.contact_planes)
else:
    ghenv.Component.AddRuntimeMessage(gh.GH_RuntimeMessageLevel.Warning, "Waiting to get a model as input.")
# ---------- end contact_zones ----------
geo = Geometry(contact_zones.zones)
panel = Panel(contact_types.types)
panel_2 = Panel(contact_neighbours.ids)
pln = Plane(contact_zones.planes)
panel_3 = Panel(contact_neighbours.pairs)
panel_4 = Panel(contact_types.strings)
branch = TreeBranch(Tree=contact_neighbours.neighbours, Path=Slider(2, range=0..10), MaintainPaths=True)

brep_2 = Brep([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])
# MODEL PROPERTIES AND TOPOLOGY
sequence_2 = DisplaySequence(breps=brep_2)
build_plate_model_2 = BuildPlateModel(run=True, breps=brep_2)  # -> model, breps, sequence, log; inputs run: Boolean, breps: list of Brep, sequence: String, constraints: tree, discard: list of String; same code as build_plate_model
plate_contours = PlateContours(model=build_plate_model_2.model)  # -> top_contour, mid_contour, bottom_contour
#   port top_contour: The contour of the top surface of each plate.
#   port mid_contour: The contour of the mid surface of each plate.
#   port bottom_contour: The contour of the bottom surface of each plate.
# ---------- plate_contours: Python ----------
__author__ = "Nicolas Rogeau"
__laboratory__ = "IBOIS, Laboratory for Timber Construction" 
__university__ = "EPFL, Ecole Polytechnique Federale de Lausanne"
__funding__ = "NCCR Digital Fabrication"
__version__ = "2024.08"
__license__ = "MIT License"
__repository__ = "https://github.com/nrogeau/Manis-timber-plate-joinery-solver"
__reference__ = "https://doi.org/10.1016/j.autcon.2021.103875"

import Grasshopper.Kernel as gh
import platesjoineryR8 as pj 
reload(pj)

if model:
    top_contour = [plate.top_contour for plate in model.plates]
    mid_contour = [plate.mid_contour for plate in model.plates]
    bottom_contour = [plate.bottom_contour for plate in model.plates]
else:
    ghenv.Component.AddRuntimeMessage(gh.GH_RuntimeMessageLevel.Warning, "Waiting to get a model as input.")
# ---------- end plate_contours ----------
plate_planes = PlatePlanes(model=build_plate_model_2.model)  # -> top_plane, mid_plane, bottom_plane
#   port top_plane: The plane of the top surface of each plate.
#   port mid_plane: The plane of the mid surface of each plate.
#   port bottom_plane: The plane of the bottom surface of each plate.
# ---------- plate_planes: Python ----------
__author__ = "Nicolas Rogeau"
__laboratory__ = "IBOIS, Laboratory for Timber Construction" 
__university__ = "EPFL, Ecole Polytechnique Federale de Lausanne"
__funding__ = "NCCR Digital Fabrication"
__version__ = "2024.08"
__license__ = "MIT License"
__repository__ = "https://github.com/nrogeau/Manis-timber-plate-joinery-solver"
__reference__ = "https://doi.org/10.1016/j.autcon.2021.103875"

import Grasshopper.Kernel as gh

if model:
    top_plane = [plate.top_plane for plate in model.plates]
    mid_plane = [plate.mid_plane for plate in model.plates]
    bottom_plane = [plate.bottom_plane for plate in model.plates]

else:
    ghenv.Component.AddRuntimeMessage(gh.GH_RuntimeMessageLevel.Warning, "Waiting to get a model as input.")
# ---------- end plate_planes ----------
plate_holes = PlateHoles(model=build_plate_model_2.model)  # -> top_holes, bottom_holes
#   port top_holes: The holes of the top surface of each plate.
#   port bottom_holes: The holes of the bottom surface of each plate.
# ---------- plate_holes: Python ----------
__author__ = "Nicolas Rogeau"
__laboratory__ = "IBOIS, Laboratory for Timber Construction" 
__university__ = "EPFL, Ecole Polytechnique Federale de Lausanne"
__funding__ = "NCCR Digital Fabrication"
__version__ = "2024.08"
__license__ = "MIT License"
__repository__ = "https://github.com/nrogeau/Manis-timber-plate-joinery-solver"
__reference__ = "https://doi.org/10.1016/j.autcon.2021.103875"

import Grasshopper.Kernel as gh
import platesjoineryR8 as pj
reload(pj)

if model:
    top_holes = [plate.top_holes for plate in model.plates]
    bottom_holes = [plate.bottom_holes for plate in model.plates]
    top_holes = pj.Toolbox.Data.list_to_datatree(top_holes)
    bottom_holes = pj.Toolbox.Data.list_to_datatree(bottom_holes)
else:
    ghenv.Component.AddRuntimeMessage(gh.GH_RuntimeMessageLevel.Warning, "Waiting to get a model as input.")
# ---------- end plate_holes ----------
plate_faces = PlateFaces(model=build_plate_model_2.model)  # -> top_face, bottom_face
#   port top_face: The top surface of each plate.
#   port bottom_face: The bottom surface of each plate.
# ---------- plate_faces: Python ----------
__author__ = "Nicolas Rogeau"
__laboratory__ = "IBOIS, Laboratory for Timber Construction" 
__university__ = "EPFL, Ecole Polytechnique Federale de Lausanne"
__funding__ = "NCCR Digital Fabrication"
__version__ = "2024.08"
__license__ = "MIT License"
__repository__ = "https://github.com/nrogeau/Manis-timber-plate-joinery-solver"
__reference__ = "https://doi.org/10.1016/j.autcon.2021.103875"

import Grasshopper.Kernel as gh

if model:
    top_face = [plate.top_face for plate in model.plates]
    bottom_face = [plate.bottom_face for plate in model.plates]
else:
    ghenv.Component.AddRuntimeMessage(gh.GH_RuntimeMessageLevel.Warning, "Waiting to get a model as input.")
# ---------- end plate_faces ----------
plate_thickness = PlateThickness(model=build_plate_model_2.model)  # -> thickness
#   port thickness: Thickness of each plate.
# ---------- plate_thickness: Python ----------
__author__ = "Nicolas Rogeau"
__laboratory__ = "IBOIS, Laboratory for Timber Construction" 
__university__ = "EPFL, Ecole Polytechnique Federale de Lausanne"
__funding__ = "NCCR Digital Fabrication"
__version__ = "2024.08"
__license__ = "MIT License"
__repository__ = "https://github.com/nrogeau/Manis-timber-plate-joinery-solver"
__reference__ = "https://doi.org/10.1016/j.autcon.2021.103875"

import Grasshopper.Kernel as gh

if model:
    thickness = [plate.thickness for plate in model.plates ]
else:
    ghenv.Component.AddRuntimeMessage(gh.GH_RuntimeMessageLevel.Warning, "Waiting to get a model as input.")
# ---------- end plate_thickness ----------
panel_5 = Panel(plate_thickness)

# ----
# START YOUTUBE TUTORIAL
button = Button()
py3 = Python3Script(run_part_1=button, run_part_2=Button())
# ---------- py3: Python ----------
import webbrowser

if run_part_1 is True:
    url = "https://www.youtube.com/watch?v=fj4rcQy4Bao"
    webbrowser.open(url)
elif run_part_2 is True:
    url = "https://www.youtube.com/watch?v=mLd-3iQQ6pc"
    webbrowser.open(url)
# ---------- end py3 ----------

brep_3 = Brep([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])
sequence_3 = DisplaySequence(breps=brep_3)
build_plate_model_3 = BuildPlateModel(run=True, breps=brep_3)  # -> model, breps, sequence, log; inputs run: Boolean, breps: list of Brep, sequence: String, constraints: tree, discard: list of String; same code as build_plate_model
# PLATE JOINTS
number_slider = Slider(3, range=1..10)
geo_2 = Geometry(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)
add_dowel_joint = AddDowelJoint(
    model=build_plate_model_3.model,
    dowel_number=number_slider,
    dowel_radius=Slider(0.1, range=0.1..0.5),
    dowel_tolerance=Slider(0, range=0..0.1),
    dowel_retreat_1=Slider(0, range=0..1),
    dowel_retreat_2=Slider(0, range=0..1),
    circle_radius=Slider(1, range=1..2),
    circle_rotation=Slider(0, range=0..360),
    dowel_angle_1=Slider(0, range=-180..180),
    dowel_angle_2=Slider(0, range=0..100),
    parallel=Toggle(True),
    tile=geo_2)  # -> model, joints_positives, joints_negatives, joints_keys; inputs plates_pairs: list of String, dowel_number: Int32, dowel_radius: Double, dowel_tolerance: Double, dowel_retreat_1: Double, dowel_retreat_2: Double, circle_radius: Double, circle_rotation: Double, dowel_angle_1: Double, dowel_angle_2: Double, parallel: Boolean, tile: Curve
#   port plates_pairs: (Optional) List of pair of plates (a,b) to only add joints between those plates.
#   port dowel_number: The number of dowels to create for each contact zones
#   port dowel_radius: The radius of the dowels.
#   port dowel_tolerance: The distance between the border of the hole and the dowel.
#   port dowel_retreat_1: The distance which separate the top of the surface of the first plate to one side of the dowel.
#   port dowel_retreat_2: The distance which separate the top of the surface of the second plate to the one side of the dowel.
#   port circle_radius: (In the case of several dowels) The radius of the circle on which the dowels are laying.
#   port circle_rotation: (In the case of several dowels) The rotation of the circle on which the dowels are laying.
#   port dowel_angle_1: The rotation of the dowel in the plane of the plate.
#   port dowel_angle_2: The rotation of the dowel through the plate.
#   port parallel: Align all dowels if True. Otherwise, the inclination of the dowels is directed towards the center of the joint.
#   port tile: (Optional) Geometric tile as polyline to customize the shape of the dowel. Tile should be drawn scale and centered on the world origin.
#   port model: Updated plate model.
#   port joints_positives: The joints to add to each plate.
#   port joints_negatives: The joints to subtract from each plate.
#   port joints_keys: The keys to insert in each plate.
# ---------- add_dowel_joint: Python ----------
__author__ = "Nicolas Rogeau"
__laboratory__ = "IBOIS, Laboratory for Timber Construction" 
__university__ = "EPFL, Ecole Polytechnique Federale de Lausanne"
__funding__ = "NCCR Digital Fabrication"
__version__ = "2024.08"
__license__ = "MIT License"
__repository__ = "https://github.com/nrogeau/Manis-timber-plate-joinery-solver"
__reference__ = "https://doi.org/10.1016/j.autcon.2021.103875"

import copy
import Grasshopper.Kernel as gh
import platesjoineryR8 as pj 
reload(pj)
        
joints_positives = []
joints_negatives = []
joints_keys = []

if model:
    model = copy.deepcopy(model)
    model.add_dowels(plates_pairs, 
        dowel_number,
        dowel_radius, 
        dowel_tolerance, 
        dowel_retreat_1, 
        dowel_retreat_2, 
        circle_radius, 
        circle_rotation, 
        dowel_angle_1,
        dowel_angle_2,
        parallel,
        tile)

    for plate in model.plates:
        joints_positives.append(plate.joints_positives)
        joints_negatives.append(plate.joints_negatives)
        joints_keys.append(plate.joints_keys)
    joints_positives = pj.Toolbox.Data.list_to_datatree(joints_positives)
    joints_negatives = pj.Toolbox.Data.list_to_datatree(joints_negatives)
    joints_keys = pj.Toolbox.Data.list_to_datatree(joints_keys)
else:
    ghenv.Component.AddRuntimeMessage(gh.GH_RuntimeMessageLevel.Warning, "Waiting to get a model as input.")
# ---------- end add_dowel_joint ----------

brep_4 = Brep([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])
sequence_4 = DisplaySequence(breps=brep_4)
build_plate_model_4 = BuildPlateModel(run=True, breps=brep_4)  # -> model, breps, sequence, log; inputs run: Boolean, breps: list of Brep, sequence: String, constraints: tree, discard: list of String; same code as build_plate_model
add_tenon_joint = AddTenonJoint(
    model=build_plate_model_4.model,
    tenon_number=Slider(3, range=0..10),
    tenon_length=Slider(0, range=0..3),
    tenon_width=Slider(1.4, range=0.1..5),
    tenon_spacing=Slider(1, range=0..10),
    tenon_shift=Slider(0, range=-1.5..1.5))  # -> model, joints_positives, joints_negatives, joints_keys; inputs plates_pairs: list of String, tenon_number: Int32, tenon_length: Double, tenon_width: Double, tenon_spacing: Double, tenon_shift: Double
#   port plates_pairs: (Optional) List of pair of plates (a,b) to only add joints between those plates.
#   port tenon_number: The number of tenons to create for each contact zones.
#   port tenon_length: (Optional) The length of the tenons. Default value will fit plate thickness.
#   port tenon_width: The width of each tenon.
#   port tenon_spacing: The space between two tenons.
#   port tenon_shift: (Optional) Shift the tenons from their central position.
#   port model: Updated plate model.
#   port joints_positives: The joints to add to each plate.
#   port joints_negatives: The joints to subtract from each plate.
#   port joints_keys: The keys to insert in each plate.
# ---------- add_tenon_joint: Python ----------
__author__ = "Nicolas Rogeau"
__laboratory__ = "IBOIS, Laboratory for Timber Construction" 
__university__ = "EPFL, Ecole Polytechnique Federale de Lausanne"
__funding__ = "NCCR Digital Fabrication"
__version__ = "2024.08"
__license__ = "MIT License"
__repository__ = "https://github.com/nrogeau/Manis-timber-plate-joinery-solver"
__reference__ = "https://doi.org/10.1016/j.autcon.2021.103875"

import copy 
import Grasshopper.Kernel as gh
import platesjoineryR8 as pj
reload(pj)

joints_positives = []
joints_negatives = []
joints_keys = []

if model:
    model = copy.deepcopy(model)
    model.add_tenons(plates_pairs, 
        tenon_number,
        tenon_length, 
        tenon_width, 
        tenon_spacing,
        tenon_shift)

    for plate in model.plates:
        joints_positives.append(plate.joints_positives)
        joints_negatives.append(plate.joints_negatives)
        joints_keys.append(plate.joints_keys)
    joints_positives = pj.Toolbox.Data.list_to_datatree(joints_positives)
    joints_negatives = pj.Toolbox.Data.list_to_datatree(joints_negatives)
    joints_keys = pj.Toolbox.Data.list_to_datatree(joints_keys)
else:
    ghenv.Component.AddRuntimeMessage(gh.GH_RuntimeMessageLevel.Warning, "Waiting to get a model as input.")
# ---------- end add_tenon_joint ----------

brep_5 = Brep([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])
sequence_5 = DisplaySequence(breps=brep_5)
build_plate_model_5 = BuildPlateModel(run=True, breps=brep_5)  # -> model, breps, sequence, log; inputs run: Boolean, breps: list of Brep, sequence: String, constraints: tree, discard: list of String; same code as build_plate_model
add_finger_joint = AddFingerJoint(
    model=build_plate_model_5.model,
    finger_number_1=Slider(3, range=0..10),
    finger_number_2=Slider(3, range=0..10),
    finger_length_1=Slider(0, range=0..3),
    finger_length_2=Slider(0, range=0..3),
    finger_width_1=Slider(1, range=0..1),
    finger_width_2=Slider(1, range=0..1),
    finger_spacing=Slider(0.36, range=0..2),
    finger_shift=Slider(0, range=0..1),
    mirror=Toggle(True))  # -> model, joints_positives, joints_negatives, joints_keys; inputs plates_pairs: list of String, finger_number_1: Int32, finger_number_2: Int32, finger_length_1: Double, finger_length_2: Double, finger_width_1: Double, finger_width_2: Double, finger_spacing: Double, finger_shift: Double, mirror: Boolean
#   port plates_pairs: (Optional) List of pair of plates (a,b) to only add joints between those plates.
#   port finger_number_1: The number of fingers on the first side.
#   port finger_number_2: The number of fingers on the second side.
#   port finger_length_1: (Optional) The length of the fingers on the first side. Default value will fit plate thickness.
#   port finger_length_2: (Optional) The length of the fingers on the second side. Default value will fit plate thickness.
#   port finger_width_2: The width of the fingers on the second side.
#   port finger_spacing: The space between two fingers.
#   port finger_shift: (Optional) Shift the fingers from their central position.
#   port mirror: Mirror the joint.
#   port model: Updated plate model.
#   port joints_positives: The joints to add to each plate.
#   port joints_negatives: The joints to subtract from each plate.
#   port joints_keys: The keys to insert in each plate.
# ---------- add_finger_joint: Python ----------
__author__ = "Nicolas Rogeau"
__laboratory__ = "IBOIS, Laboratory for Timber Construction" 
__university__ = "EPFL, Ecole Polytechnique Federale de Lausanne"
__funding__ = "NCCR Digital Fabrication"
__version__ = "2024.08"
__license__ = "MIT License"
__repository__ = "https://github.com/nrogeau/Manis-timber-plate-joinery-solver"
__reference__ = "https://doi.org/10.1016/j.autcon.2021.103875"

import copy
import Grasshopper.Kernel as gh
import platesjoineryR8 as pj 
reload(pj)

joints_positives = []
joints_negatives = []
joints_keys = []

if model:
    model = copy.deepcopy(model)
    model.add_fingers(plates_pairs,
            finger_number_1,
            finger_length_1,
            finger_width_1,
            finger_number_2,
            finger_length_2,
            finger_width_2,
            finger_spacing,
            finger_shift,
            mirror)

    for plate in model.plates:
        joints_positives.append(plate.joints_positives)
        joints_negatives.append(plate.joints_negatives)
        joints_keys.append(plate.joints_keys)
    joints_positives = pj.Toolbox.Data.list_to_datatree(joints_positives)
    joints_negatives = pj.Toolbox.Data.list_to_datatree(joints_negatives)
    joints_keys = pj.Toolbox.Data.list_to_datatree(joints_keys)
else:
    ghenv.Component.AddRuntimeMessage(gh.GH_RuntimeMessageLevel.Warning, "Waiting to get a model as input.")
# ---------- end add_finger_joint ----------

brep_6 = Brep([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])
sequence_6 = DisplaySequence(breps=brep_6)
build_plate_model_6 = BuildPlateModel(run=True, breps=brep_6)  # -> model, breps, sequence, log; inputs run: Boolean, breps: list of Brep, sequence: String, constraints: tree, discard: list of String; same code as build_plate_model
add_half_lap_joint = AddHalfLapJoint(
    model=build_plate_model_6.model,
    proportion=Slider(0.5, range=0.1..0.9),
    tolerance=Slider(0, range=0..1),
    min_angle=Slider(79, range=0..100),
    straight_height=Slider(0.8, range=0..1),
    fillet_height=Slider(0.6, range=0..1),
    segments=Slider(10, range=0..10))  # -> model, joints_positives, joints_negatives, joints_keys; inputs plates_pairs: list of String, proportion: Double, tolerance: Double, min_angle: Double, straight_height: Double, fillet_height: Double, segments: Int32
#   port plates_pairs: (Optional) List of pair of plates (a,b) to only add joints between those plates.
#   port proportion: The proportion of the cut (default halflap = 0.5) between both pieces.
#   port tolerance: Chamfer the halflap joint to add more tolerance for assembly.
#   port min_angle: If joint with tolerance: minimum angle for the slope of the optional chamfer (usually around 45 degrees)."
#   port straight_height: If joint with tolerance: size of the part of the notch without chamfer.
#   port fillet_height: If joint with tolerance: size of the rounded part of the notch.
#   port segments: If joint with tolerance: number of segments for the discretization of the opening curve.
#   port model: Updated plate model.
#   port joints_positives: The joints to add to each plate.
#   port joints_negatives: The joints to subtract from each plate.
#   port joints_keys: The keys to insert in each plate.
# ---------- add_half_lap_joint: Python ----------
__author__ = "Nicolas Rogeau"
__laboratory__ = "IBOIS, Laboratory for Timber Construction" 
__university__ = "EPFL, Ecole Polytechnique Federale de Lausanne"
__funding__ = "NCCR Digital Fabrication"
__version__ = "2024.08"
__license__ = "MIT License"
__repository__ = "https://github.com/nrogeau/Manis-timber-plate-joinery-solver"
__reference__ = "https://doi.org/10.1016/j.autcon.2021.103875"

import copy
import Grasshopper.Kernel as gh
import platesjoineryR8 as pj 
reload(pj)

joints_positives = []
joints_negatives = []
joints_keys = []
if proportion == 0.0: proportion = 0.5
if model:
    model = copy.deepcopy(model)
    model.add_halflap(plates_pairs, 
        proportion,
        tolerance,
        min_angle,
        straight_height,
        fillet_height,
        segments)

    for plate in model.plates:
        joints_positives.append(plate.joints_positives)
        joints_negatives.append(plate.joints_negatives)
        joints_keys.append(plate.joints_keys)
    joints_positives = pj.Toolbox.Data.list_to_datatree(joints_positives)
    joints_negatives = pj.Toolbox.Data.list_to_datatree(joints_negatives)
    joints_keys = pj.Toolbox.Data.list_to_datatree(joints_keys)
else:
    ghenv.Component.AddRuntimeMessage(gh.GH_RuntimeMessageLevel.Warning, "Waiting to get a model as input.")
# ---------- end add_half_lap_joint ----------

brep_7 = Brep([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])
sequence_7 = DisplaySequence(breps=brep_7)
build_plate_model_7 = BuildPlateModel(run=True, breps=brep_7)  # -> model, breps, sequence, log; inputs run: Boolean, breps: list of Brep, sequence: String, constraints: tree, discard: list of String; same code as build_plate_model
add_sunrise_joint = AddSunriseJoint(
    model=build_plate_model_7.model,
    tenon_number=Slider(5, range=0..10),
    tenon_width=Slider(0.5, range=0.1..2),
    tenon_spacing=Slider(0.5, range=0.1..2),
    tenon_shift=Slider(0, range=0..1),
    spread_angle=Slider(45, range=0..45),
    parallel_tenons=Toggle(False))  # -> model, joints_positives, joints_negatives, joints_keys; inputs plates_pairs: list of String, tenon_number: Int32, tenon_width: Double, tenon_spacing: Double, spread_angle: Double, parallel_tenons: Boolean
#   port plates_pairs: (Optional) List of pair of plates (a,b) to only add joints between those plates.
#   port tenon_number: The number of dowels to create for each contact zones
#   port tenon_width: The radius of the dowels.
#   port model: Updated plate model.
#   port joints_positives: The joints to add to each plate.
#   port joints_negatives: The joints to subtract from each plate.
#   port joints_keys: The keys to insert in each plate.
# ---------- add_sunrise_joint: Python ----------
__author__ = "Nicolas Rogeau"
__laboratory__ = "IBOIS, Laboratory for Timber Construction" 
__university__ = "EPFL, Ecole Polytechnique Federale de Lausanne"
__funding__ = "NCCR Digital Fabrication"
__version__ = "2024.08"
__license__ = "MIT License"
__repository__ = "https://github.com/nrogeau/Manis-timber-plate-joinery-solver"
__reference__ = "https://doi.org/10.1016/j.autcon.2021.103875"

import copy
import Grasshopper.Kernel as gh
import platesjoineryR8 as pj 
reload(pj)
        
joints_positives = []
joints_negatives = []
joints_keys = []

if model:
    model = copy.deepcopy(model)
    custom_insertion = None
    model.add_sunrise(plates_pairs, 
        tenon_number,
        tenon_width, 
        tenon_spacing,
        tenon_shift,
        spread_angle,
        parallel_tenons,
        custom_insertion)

    for plate in model.plates:
        joints_positives.append(plate.joints_positives)
        joints_negatives.append(plate.joints_negatives)
        joints_keys.append(plate.joints_keys)
    joints_positives = pj.Toolbox.Data.list_to_datatree(joints_positives)
    joints_negatives = pj.Toolbox.Data.list_to_datatree(joints_negatives)
    joints_keys = pj.Toolbox.Data.list_to_datatree(joints_keys)
else:
    ghenv.Component.AddRuntimeMessage(gh.GH_RuntimeMessageLevel.Warning, "Waiting to get a model as input.")
# ---------- end add_sunrise_joint ----------

create_constraint = CreateConstraint(alpha=Slider(180, range=45..180), beta=Slider(0, range=0..100))  # -> constraint, boundaries; inputs alpha: Double, beta: Double
#   port alpha: Horizontal constraint angle.
#   port beta: Vertical constraint angle.
#   port constraint: Constrained insertion space.
#   port boundaries: Boundary surfaces constraining the insertion space.
# ---------- create_constraint: Python ----------
__author__ = "Nicolas Rogeau"
__laboratory__ = "IBOIS, Laboratory for Timber Construction" 
__university__ = "EPFL, Ecole Polytechnique Federale de Lausanne"
__funding__ = "NCCR Digital Fabrication"
__version__ = "2024.08"
__license__ = "MIT License"
__repository__ = "https://github.com/nrogeau/Manis-timber-plate-joinery-solver"
__reference__ = "https://doi.org/10.1016/j.autcon.2021.103875"

import Grasshopper.Kernel as gh
import platesjoineryR8 as pj
import rhinoscriptsyntax as rs

sphere =  rs.AddSphere((0,0,0),1)
cutter = rs.AddPlanarSrf(rs.AddPolyline([(1,1,0),(1,-1,0),(-1,-1,0),(-1,1,0),(1,1,0)]))
hemisphere = rs.SplitBrep(sphere,cutter)[1]

if alpha is None: alpha = 90
if beta is None: beta = 45

boundaries = [cutter[0]]
cutter2 = rs.RotateObject(cutter,(0,0,0),90+(alpha/2),(0,1,0),(True))
cutter3 = rs.RotateObject(cutter,(0,0,0),90-(alpha/2),(0,1,0),(True))
cutter4 = rs.RotateObject(cutter,(0,0,0),90+(beta/2),(1,0,0),(True))
cutter5 = rs.RotateObject(cutter,(0,0,0),90-(beta/2),(1,0,0),(True))
boundaries.append(cutter2)
boundaries.append(cutter3)
boundaries.append(cutter4)
boundaries.append(cutter5)

if alpha == 0:
    if beta == 0:
        constraint = rs.AddPoint(0,0,1)
    else:
        arc = rs.AddArc(rs.WorldYZPlane(),1,beta)
        constraint = rs.RotateObject(arc,(0,0,0),90-(beta/2),(1,0,0),(True))
else:
    if beta == 0:
        arc = rs.AddArc(rs.WorldZXPlane(),1,alpha)
        constraint = rs.RotateObject(arc,(0,0,0),-(alpha/2),(0,1,0),(True))
    else:
        constraint = hemisphere
        if alpha<180:
            constraint = rs.SplitBrep(constraint,cutter2)[0]
            constraint = rs.SplitBrep(constraint,cutter3)[1]
        if beta<180:
            constraint = rs.SplitBrep(constraint,cutter4)[0]
            constraint = rs.SplitBrep(constraint,cutter5)[1]
# ---------- end create_constraint ----------
merge_constraints = MergeConstraints(FS=create_constraint.constraint)  # -> constraints
#   port FF: Horizontal constraint angle.
#   port FS: Vertical constraint angle.
#   port constraints: Datatree containing all constraints for all contact types.
# ---------- merge_constraints: Python ----------
__author__ = "Nicolas Rogeau"
__laboratory__ = "IBOIS, Laboratory for Timber Construction" 
__university__ = "EPFL, Ecole Polytechnique Federale de Lausanne"
__funding__ = "NCCR Digital Fabrication"
__version__ = "2024.08"
__license__ = "MIT License"
__repository__ = "https://github.com/nrogeau/Manis-timber-plate-joinery-solver"
__reference__ = "https://doi.org/10.1016/j.autcon.2021.103875"

import Grasshopper.Kernel as gh
import platesjoineryR8 as pj

constraints = [[], [], [], [], []]
if FF: constraints[0] = [FF]
if FS: constraints[1] = [FS]
if ES: constraints[2] = [ES]
if SS: constraints[3] = [SS]
if IN: constraints[4] = [IN]
constraints = pj.Toolbox.Data.list_to_datatree(constraints)
# ---------- end merge_constraints ----------
brep_8 = Brep([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])
build_plate_model_8 = BuildPlateModel(run=True, breps=brep_8, constraints=merge_constraints)  # -> model, breps, sequence, log; inputs run: Boolean, breps: list of Brep, sequence: String, constraints: tree, discard: list of String; same code as build_plate_model
sequence_8 = DisplaySequence(breps=build_plate_model_8.breps)
contact_spaces = ContactSpaces(model=build_plate_model_8.model)  # -> spheres, grouped; inputs scale: Double
#   port scale: Scale factor.
#   port spheres: Local insertion spaces represented as spheres centered on each contact zone.
#   port grouped: Local insertion spaces represented as spheres grouped at the origin.
# ---------- contact_spaces: Python ----------
__author__ = "Nicolas Rogeau"
__laboratory__ = "IBOIS, Laboratory for Timber Construction" 
__university__ = "EPFL, Ecole Polytechnique Federale de Lausanne"
__funding__ = "NCCR Digital Fabrication"
__version__ = "2024.08"
__license__ = "MIT License"
__repository__ = "https://github.com/nrogeau/Manis-timber-plate-joinery-solver"
__reference__ = "https://doi.org/10.1016/j.autcon.2021.103875"

import Grasshopper.Kernel as gh
import Rhino.Geometry as rg
import platesjoineryR8 as pj
from copy import deepcopy as copy

if model:
    if scale is None: scale = 1
    if model:
        spheres = copy(model.contact_spheres)
        grouped = copy(model.contact_spheres)
        for i in range(len(model.contact_spheres)):
            for j in range(len(model.contact_spheres[i])):
                scale_transform = rg.Transform.Scale(model.contact_centers[i][j], scale)
                spheres[i][j].Transform(scale_transform)
                translation_vector = -rg.Vector3d(model.contact_centers[i][j])
                translation_transform = rg.Transform.Translation(translation_vector)
                grouped[i][j] = model.contact_spheres[i][j].Duplicate()
                grouped[i][j].Transform(translation_transform)
                scale_transform_grouped = rg.Transform.Scale(rg.Point3d(0, 0, 0), scale)
                grouped[i][j].Transform(scale_transform_grouped)
        spheres = pj.Toolbox.Data.list_to_datatree(spheres)
        grouped = pj.Toolbox.Data.list_to_datatree(grouped)   
else:
    ghenv.Component.AddRuntimeMessage(gh.GH_RuntimeMessageLevel.Warning, "Waiting to get a model as input.")
# ---------- end contact_spaces ----------
contact_zones_2 = ContactZones(model=build_plate_model_8.model)  # -> zones, planes; same code as contact_zones
number_slider_2 = Slider(2, range=0..10)
scale = Scale(Geometry=contact_spaces.spheres, Center=contact_zones_2.planes, Factor=Slider(1, range=0..10))  # -> Geometry, Transform
animate_assembly = AnimateAssembly(module=build_plate_model_8.model, progress=Slider(0, range=0..1), retreat=Slider(10, range=0..10))  # -> breps, status; inputs progress: Double, retreat: Double
#   port module: Plate module or plate model.
#   port progress: Animation progression from 0 to 1.
#   port retreat: Length of the insertion path.
#   port breps: Show breps in motion.
#   port status: Assembly progression.
# ---------- animate_assembly: Python ----------
__author__ = "Nicolas Rogeau"
__laboratory__ = "IBOIS, Laboratory for Timber Construction" 
__university__ = "EPFL, Ecole Polytechnique Federale de Lausanne"
__funding__ = "NCCR Digital Fabrication"
__version__ = "2024.08"
__license__ = "MIT License"
__repository__ = "https://github.com/nrogeau/Manis-timber-plate-joinery-solver"
__reference__ = "https://doi.org/10.1016/j.autcon.2021.103875"

import ast 
import rhinoscriptsyntax as rs
import Grasshopper.Kernel as gh
import platesjoineryR8 as pj
reload(pj)

if module:
    # If model as input, take last module for animation.
    if hasattr(module, 'model') is False:
        module = module.modules[-1]

    #start of insertion
    if progress == 0: 
        status = ('start of insertion sequence')
    else:
        vectors = module.assembly_vectors
        count = module.count
        seq = ast.literal_eval(module.sequence)
        breps = []
        progress = progress * count
        deci = progress - int(progress)

        # animation
        for i in range(count):
            if vectors[i] == "gravity": vectors[i] = rs.VectorCreate((0,0,-1),(0,0,0))
            # standing plates
            if i < int(progress) :
                plate_ids = pj.Toolbox.Data.flatten_integer_list(seq[i])
                if type(plate_ids) is list:
                    for integer in plate_ids:
                        breps.append(rs.CopyObject(module.model.plates[integer].brep))
                else: breps.append(rs.CopyObject(module.model.plates[plate_ids].brep))
            # moving plates
            if i == int(progress) :
                if type(seq[i]) is list:
                    plate_ids = pj.Toolbox.Data.flatten_integer_list(seq[i])
                    for integer in plate_ids:
                        breps.append(rs.CopyObject(module.model.plates[integer].brep, -(1-deci)*retreat*vectors[i]))
                else: breps.append(rs.CopyObject(module.model.plates[seq[i]].brep, -(1-deci)*retreat*vectors[i]))

        # ongoing status
        perc = 100*(progress - int(progress))
        status = ('plate '+ str(int(progress)) + ' inserted at ' + str(perc)+ ' %.')

        # end status
        if progress == 1: status = ('end of insertion sequence')

    if breps is not None: 
        for i in range(len(breps)): breps[i]= rs.coercebrep(breps[i])
else:
    ghenv.Component.AddRuntimeMessage(gh.GH_RuntimeMessageLevel.Warning, "Waiting to get a module or model as input.")
# ---------- end animate_assembly ----------
branch_2 = TreeBranch(Tree=contact_spaces.grouped, Path=number_slider_2, MaintainPaths=True)
branch_3 = TreeBranch(Tree=scale.Geometry, Path=number_slider_2, MaintainPaths=True)
item = ListItem(List=branch_2, Index=0, Wrap=True)  # -> Item, Item1
geo_3 = Geometry(item.Item)
geo_4 = Geometry(item.Item1)

brep_9 = Brep([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])
sequence_9 = DisplaySequence(breps=brep_9)
build_plate_model_9 = BuildPlateModel(run=True, breps=brep_9)  # -> model, breps, sequence, log; inputs run: Boolean, breps: list of Brep, sequence: String, constraints: tree, discard: list of String; same code as build_plate_model
number_slider_3 = Slider(1, range=0..1)
number_slider_4 = Slider(1, range=0..10)
add_finger_joint_2 = AddFingerJoint(
    model=build_plate_model_9.model,
    finger_number_1=number_slider_3,
    finger_number_2=number_slider_3,
    finger_width_1=number_slider_4,
    finger_width_2=number_slider_4)  # -> model, joints_positives, joints_negatives, joints_keys; inputs plates_pairs: list of String, finger_number_1: Int32, finger_number_2: Int32, finger_length_1: Double, finger_length_2: Double, finger_width_1: Double, finger_width_2: Double, finger_spacing: Double, finger_shift: Double, mirror: Boolean; same code as add_finger_joint
number_slider_5 = Slider(0.001, range=0..0.001)
merge_joints = MergeJoints(run=True, model=add_finger_joint_2.model, boolean_tol=number_slider_5, merge_tol=number_slider_5)  # -> model, breps, log; inputs run: Boolean, plates_ids: list of Int32, boolean_tol: Double, merge_tol: Double
#   port run: Run solver if True.
#   port plates_ids: (Optional) List of plates to only merge joints for those plates.
#   port boolean_tol: (Optional) Adjust the tolerance for boolean operations.
#   port merge_tol: (Optional) Adjust the tolerance for merging coplanar faces.
#   port breps: List of merged breps.
#   port log: Message from solver.
# ---------- merge_joints: Python ----------
"""Build a plate model"""

import copy
import Grasshopper.Kernel as gh
import platesjoineryR8 as pj
reload(pj)


if model:
    if run is True or run == None:
        if boolean_tol == 0.0: boolean_tol = 0.1
        if merge_tol == 0.0: boolean_tol = 0.1
        model = copy.deepcopy(model)
        model.perform_boolean_operations(plates_ids, boolean_tol, merge_tol)
        breps = []
        for i in range(model.count):
            breps.append(model.plates[i].brep)
else:
    ghenv.Component.AddRuntimeMessage(gh.GH_RuntimeMessageLevel.Warning, "Waiting to get a model as input.")
# ---------- end merge_joints ----------
animate_assembly_2 = AnimateAssembly(module=merge_joints.model, progress=Slider(0, range=0..1), retreat=Slider(10, range=0..10))  # -> breps, status; inputs progress: Double, retreat: Double; same code as animate_assembly

# ----
# ASSEMBLY SEQUENCE AND INSERTION CONSTRAINTS
brep_10 = Brep([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])
build_plate_model_10 = BuildPlateModel(run=True, breps=brep_10, sequence="[2,1,0]")  # -> model, breps, sequence, log; inputs run: Boolean, breps: list of Brep, sequence: String, constraints: tree, discard: list of String; same code as build_plate_model
panel_6 = Panel(build_plate_model_10.sequence)
sequence_10 = DisplaySequence(breps=build_plate_model_10.breps)
animate_assembly_3 = AnimateAssembly(module=build_plate_model_10.model, progress=Slider(0, range=0..1), retreat=Slider(10, range=0..10))  # -> breps, status; inputs progress: Double, retreat: Double; same code as animate_assembly

brep_11 = Brep([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])
sequence_11 = DisplaySequence(breps=brep_11)
build_plate_model_11 = BuildPlateModel(run=True, breps=brep_11, sequence="[[0,1,2],[3,4,5]]")  # -> model, breps, sequence, log; inputs run: Boolean, breps: list of Brep, sequence: String, constraints: tree, discard: list of String; same code as build_plate_model
# MODULAR ASSEMBLIES
add_tenon_joint_2 = AddTenonJoint(
    model=build_plate_model_11.model,
    tenon_number=Slider(2, range=0..10),
    tenon_width=Slider(1, range=0..1),
    tenon_spacing=Slider(2, range=0.1..2))  # -> model, joints_positives, joints_negatives, joints_keys; inputs plates_pairs: list of String, tenon_number: Int32, tenon_length: Double, tenon_width: Double, tenon_spacing: Double, tenon_shift: Double
#   port plates_pairs: (Optional) List of pair of plates (a,b) to only add joints between those plates.
#   port tenon_number: The number of tenons to create for each contact zones.
#   port tenon_length: (Optional) The length of the tenons. Default value will fit plate thickness.
#   port tenon_width: The width of each tenon.
#   port tenon_spacing: The space between two tenons.
#   port tenon_shift: (Optional) Shift the tenons from their central position.
#   port model: Updated plate model.
#   port joints_positives: The joints to add to each plate.
#   port joints_negatives: The joints to subtract from each plate.
#   port joints_keys: The keys to insert in each plate.
# ---------- add_tenon_joint_2: Python ----------
__author__ = "Nicolas Rogeau"
__laboratory__ = "IBOIS, Laboratory for Timber Construction" 
__university__ = "EPFL, Ecole Polytechnique Federale de Lausanne"
__funding__ = "NCCR Digital Fabrication"
__version__ = "2024.08"
__license__ = "MIT License"
__repository__ = "https://github.com/nrogeau/Manis-timber-plate-joinery-solver"
__reference__ = "https://doi.org/10.1016/j.autcon.2021.103875"

import copy 
import Grasshopper.Kernel as gh
import platesjoineryR8 as pj
reload(pj)


joints_positives = []
joints_negatives = []
joints_keys = []

if model:
    model = copy.deepcopy(model)
    model.add_tenons(plates_pairs, 
        tenon_number,
        tenon_length, 
        tenon_width, 
        tenon_spacing,
        tenon_shift)

    for plate in model.plates:
        joints_positives.append(plate.joints_positives)
        joints_negatives.append(plate.joints_negatives)
        joints_keys.append(plate.joints_keys)
    joints_positives = pj.Toolbox.Data.list_to_datatree(joints_positives)
    joints_negatives = pj.Toolbox.Data.list_to_datatree(joints_negatives)
    joints_keys = pj.Toolbox.Data.list_to_datatree(joints_keys)
else:
    ghenv.Component.AddRuntimeMessage(gh.GH_RuntimeMessageLevel.Warning, "Waiting to get a model as input.")
# ---------- end add_tenon_joint_2 ----------
number_slider_6 = Slider(0.001, range=0..0.001)
merge_joints_2 = MergeJoints(run=Toggle(True), model=add_tenon_joint_2.model, boolean_tol=number_slider_6, merge_tol=number_slider_6)  # -> model, breps, log; inputs run: Boolean, plates_ids: list of Int32, boolean_tol: Double, merge_tol: Double; same code as merge_joints
split_decimal = SplitDecimal(num=Slider(0, range=0..3))  # -> integer, decimal; inputs num: Double
#   port integer: Integer part.
#   port decimal: Decimal part.
# ---------- split_decimal: Python ----------
__author__ = "Nicolas Rogeau"
__laboratory__ = "IBOIS, Laboratory for Timber Construction" 
__university__ = "EPFL, Ecole Polytechnique Federale de Lausanne"
__funding__ = "NCCR Digital Fabrication"
__version__ = "2024.08"
__license__ = "MIT License"
__repository__ = "https://github.com/nrogeau/Manis-timber-plate-joinery-solver"
__reference__ = "https://doi.org/10.1016/j.autcon.2021.103875"

if num is not None:             
    st = str(num).split(".")
    integer = int(st[0])
    decimal = float("0."+st[1])
# ---------- end split_decimal ----------
get_modules = GetModules(model=merge_joints_2.model, module_id=split_decimal.integer)  # -> module, sequence, step; inputs module_id: Int32
#   port module: Module(s) inheriting model functions.
#   port sequence: Sub-sequence of the module.
#   port step: Tag representing the position of the module in the full assembly sequence. 'M' stands for the final step of the Model.
# ---------- get_modules: Python ----------
__author__ = "Nicolas Rogeau"
__laboratory__ = "IBOIS, Laboratory for Timber Construction" 
__university__ = "EPFL, Ecole Polytechnique Federale de Lausanne"
__funding__ = "NCCR Digital Fabrication"
__version__ = "2024.08"
__license__ = "MIT License"
__repository__ = "https://github.com/nrogeau/Manis-timber-plate-joinery-solver"
__reference__ = "https://doi.org/10.1016/j.autcon.2021.103875"

import rhinoscriptsyntax as rs
import Grasshopper.Kernel as gh
import platesjoineryR8 as pj
reload(pj)

if model:
    if module_id != None:
        module_id = module_id % len(model.modules)
        module = model.modules[module_id]
        breps = model.modules[module_id].breps
        step = str(model.modules[module_id].step)
        sequence = str(model.modules[module_id].sequence)
        assembly_vectors = []
        for i in range(len(model.modules[module_id].assembly_vectors)):
            vector = model.modules[module_id].assembly_vectors[i]
            if vector == "gravity": vector = rs.VectorCreate((0,0,-1),(0,0,0))
            assembly_vectors.append(pj.Toolbox.Vectors.round_vector(vector,6))
    else:
        module = []
        breps = []
        sequence = []
        step = []
        assembly_vectors = []
        for mod in model.modules:
            module.append(mod)
            breps.append(mod.breps)
            sequence.append(str(mod.sequence))
            step.append(str(mod.step))
            sub_assembly_vectors = []
            for vec in mod.assembly_vectors:
                if vec == "gravity": vec = rs.VectorCreate((0,0,-1),(0,0,0))
                sub_assembly_vectors.append(pj.Toolbox.Vectors.round_vector(vec,6))
            assembly_vectors.append(sub_assembly_vectors)
        breps = pj.Toolbox.Data.list_to_datatree(breps)
        assembly_vectors = pj.Toolbox.Data.list_to_datatree(assembly_vectors)
else:
    ghenv.Component.AddRuntimeMessage(gh.GH_RuntimeMessageLevel.Warning, "Waiting to get a model as input.")
# ---------- end get_modules ----------
animate_assembly_4 = AnimateAssembly(module=get_modules.module, progress=split_decimal.decimal, retreat=Slider(10, range=0..10))  # -> breps, status; inputs progress: Double, retreat: Double
#   port module: Plate module or plate model.
#   port progress: Animation progression from 0 to 1.
#   port retreat: Length of the insertion path.
#   port breps: Show breps in motion.
#   port status: Assembly progression.
# ---------- animate_assembly_4: Python ----------
__author__ = "Nicolas Rogeau"
__laboratory__ = "IBOIS, Laboratory for Timber Construction" 
__university__ = "EPFL, Ecole Polytechnique Federale de Lausanne"
__funding__ = "NCCR Digital Fabrication"
__version__ = "2024.08"
__license__ = "MIT License"
__repository__ = "https://github.com/nrogeau/Manis-timber-plate-joinery-solver"
__reference__ = "https://doi.org/10.1016/j.autcon.2021.103875"

import ast 
import rhinoscriptsyntax as rs
import Grasshopper.Kernel as gh
import platesjoineryR8 as pj
reload(pj)
print type(module)
if module:
    # If model as input, take last module for animation.
    if hasattr(module, 'model') is False:
        
        module = module.modules[-1]
        

    #start of insertion
    if progress == 0: 
        status = ('start of insertion sequence')
    else:
        vectors = module.assembly_vectors
        count = module.count
        seq = ast.literal_eval(module.sequence)
        breps = []
        progress = progress * count
        deci = progress - int(progress)

        # animation
        for i in range(count):
            if vectors[i] == "gravity": vectors[i] = rs.VectorCreate((0,0,-1),(0,0,0))
            # standing plates
            if i < int(progress) :
                plate_ids = pj.Toolbox.Data.flatten_integer_list(seq[i])
                if type(plate_ids) is list:
                    for integer in plate_ids:
                        breps.append(rs.CopyObject(module.model.plates[integer].brep))
                else: breps.append(rs.CopyObject(module.model.plates[plate_ids].brep))
            # moving plates
            if i == int(progress) :
                if type(seq[i]) is list:
                    plate_ids = pj.Toolbox.Data.flatten_integer_list(seq[i])
                    for integer in plate_ids:
                        breps.append(rs.CopyObject(module.model.plates[integer].brep, -(1-deci)*retreat*vectors[i]))
                else: breps.append(rs.CopyObject(module.model.plates[seq[i]].brep, -(1-deci)*retreat*vectors[i]))

        # ongoing status
        perc = 100*(progress - int(progress))
        status = ('plate '+ str(int(progress)) + ' inserted at ' + str(perc)+ ' %.')

        # end status
        if progress == 1: status = ('end of insertion sequence')

    if breps is not None: 
        for i in range(len(breps)): breps[i]= rs.coercebrep(breps[i])
else:
    ghenv.Component.AddRuntimeMessage(gh.GH_RuntimeMessageLevel.Warning, "Waiting to get a module or model as input.")
# ---------- end animate_assembly_4 ----------

# ----
# Turn preview on to display
# robot, plates, and trajectory
brep_12 = Brep([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])
build_plate_model_12 = BuildPlateModel(run=True, breps=brep_12)  # -> model, breps, sequence, log; inputs run: Boolean, breps: list of Brep, sequence: String, constraints: tree, discard: list of String; same code as build_plate_model
number_slider_7 = Slider(100, range=0..100)
add_sunrise_joint_2 = AddSunriseJoint(
    model=build_plate_model_12.model,
    tenon_number=1,
    tenon_width=number_slider_7,
    tenon_spacing=number_slider_7,
    spread_angle=Slider(30, range=0..100))  # -> model, joints_positives, joints_negatives, joints_keys; inputs plates_pairs: list of String, tenon_number: Int32, tenon_width: Double, tenon_spacing: Double, spread_angle: Double, parallel_tenons: Boolean; same code as add_sunrise_joint
merge_joints_3 = MergeJoints(run=True, model=add_sunrise_joint_2.model)  # -> model, breps, log; inputs run: Boolean, plates_ids: list of Int32, boolean_tol: Double, merge_tol: Double; same code as merge_joints
# ROBOTIC ASSEMBLY
geo_5 = Geometry(Point(912, -1890, 0))
sequence_12 = DisplaySequence(breps=merge_joints_3.breps)
panel_7 = Panel("""1
2
4""")
animate_assembly_5 = AnimateAssembly(module=merge_joints_3.model, progress=Slider(1, range=0..1), retreat=Slider(10, range=0..10), hold=True)  # -> breps, status; inputs progress: Double, retreat: Double, hold: Boolean
#   port module: Plate module or plate model.
#   port progress: Animation progression from 0 to 1.
#   port retreat: Length of the insertion path.
#   port hold: If True, plates will be held in place during half of the progress bar, which allow to display to final result. If False, the display will only show plates on the move.
#   port breps: Show breps in motion.
#   port status: Assembly progression.
# ---------- animate_assembly_5: Python ----------
__author__ = "Nicolas Rogeau"
__laboratory__ = "IBOIS, Laboratory for Timber Construction" 
__university__ = "EPFL, Ecole Polytechnique Federale de Lausanne"
__funding__ = "NCCR Digital Fabrication"
__version__ = "2024.08"
__license__ = "MIT License"
__repository__ = "https://github.com/nrogeau/Manis-timber-plate-joinery-solver"
__reference__ = "https://doi.org/10.1016/j.autcon.2021.103875"

import ast 
import rhinoscriptsyntax as rs
import Grasshopper.Kernel as gh
import platesjoineryR8 as pj
reload(pj)

if module:
    # If model as input, take last module for animation.
    if hasattr(module, 'model') is False:
        module = module.modules[-1]

    #start of insertion
    if progress == 0: 
        status = ('start of insertion sequence')
    else:
        vectors = module.assembly_vectors
        count = module.count
        seq = ast.literal_eval(module.sequence)
        breps = []
        progress = progress * count
        deci = progress - int(progress)

        # animation
        for i in range(count):
            if vectors[i] == "gravity": vectors[i] = rs.VectorCreate((0,0,-1),(0,0,0))
            # standing plates
            if i < int(progress) :
                plate_ids = pj.Toolbox.Data.flatten_integer_list(seq[i])
                if type(plate_ids) is list:
                    for integer in plate_ids:
                        breps.append(rs.CopyObject(module.model.plates[integer].brep))
                else: breps.append(rs.CopyObject(module.model.plates[plate_ids].brep))
            # moving plates
            if i == int(progress) :
                if type(seq[i]) is list:
                    plate_ids = pj.Toolbox.Data.flatten_integer_list(seq[i])
                    for integer in plate_ids:
                        if hold is False:
                            breps.append(rs.CopyObject(module.model.plates[integer].brep, -(1-deci)*retreat*vectors[i]))
                        else:
                            if deci >= 0.5: eff_deci = 1
                            else: eff_deci = 2*deci
                            breps.append(rs.CopyObject(module.model.plates[integer].brep, -(1-eff_deci)*retreat*vectors[i]))
                else: 
                    if hold is False:
                        breps.append(rs.CopyObject(module.model.plates[seq[i]].brep, -(1-deci)*retreat*vectors[i]))
                    else:
                        if deci >= 0.5: eff_deci = 1
                        else: eff_deci = 2*deci
                        breps.append(rs.CopyObject(module.model.plates[seq[i]].brep, -(1-eff_deci)*retreat*vectors[i]))

        # ongoing status
        perc = 100*(progress - int(progress))
        status = ('plate '+ str(int(progress)) + ' inserted at ' + str(perc)+ ' %.')

        # end status
        if progress == 1: status = ('end of insertion sequence')

    if breps is not None: 
        for i in range(len(breps)): breps[i]= rs.coercebrep(breps[i])
else:
    ghenv.Component.AddRuntimeMessage(gh.GH_RuntimeMessageLevel.Warning, "Waiting to get a module or model as input.")
# ---------- end animate_assembly_5 ----------
stack_model = StackModel(model=merge_joints_3.model, plane=geo_5, flip=panel_7)  # -> model, breps; inputs plane: Plane, flip: list of String
#   port plane: Stack location and orientation.
#   port flip: (Optional) List of plates to flip.
#   port model: Transformed plate model.
#   port breps: Transformed breps.
# ---------- stack_model: Python ----------
__author__ = "Nicolas Rogeau"
__laboratory__ = "IBOIS, Laboratory for Timber Construction" 
__university__ = "EPFL, Ecole Polytechnique Federale de Lausanne"
__funding__ = "NCCR Digital Fabrication"
__version__ = "2024.08"
__license__ = "MIT License"
__repository__ = "https://github.com/nrogeau/Manis-timber-plate-joinery-solver"
__reference__ = "https://doi.org/10.1016/j.autcon.2021.103875"

import copy
import Rhino.Geometry as rg
import Grasshopper.Kernel as gh
import platesjoineryR8 as pj
reload(pj)

if model:
    model = copy.deepcopy(model)
    model.transform('Stack', plane, None, flip, None)
    breps = []
    for i in range(model.count):
        breps.append(model.plates[i].brep)

else:
    ghenv.Component.AddRuntimeMessage(gh.GH_RuntimeMessageLevel.Warning, "Waiting to get a model as input.")
# ---------- end stack_model ----------
sequence_13 = DisplaySequence(breps=animate_assembly_5.breps)
robot_trajectory = RobotTrajectory(
    stack_module=stack_model.model,
    goal_module=merge_joints_3.model,
    up_dist=Slider(600, range=0..1000),
    retreat_dist=Slider(100, range=0..1000))  # -> planes; inputs plates_id: list of String, safe_spot: Plane, up_dist: Double, retreat_dist: Double
#   port stack_module: The plate module stacked in range of the robotic arm.
#   port goal_module: The plate module to assemble in range of the robotic arm.
#   port plates_id: (Optional) List of plates to assemble with a robot.
#   port safe_spot: A plane where the robot can safely move between the assembly of each plate.
#   port up_dist: The distance above the assembly where the robot should travel.
#   port retreat_dist: The distance that the robot should travel to retreat after the insertion of the plate.
#   port planes: The list of planes for the robot trajectory.
# ---------- robot_trajectory: Python ----------
__author__ = "Nicolas Rogeau"
__laboratory__ = "IBOIS, Laboratory for Timber Construction" 
__university__ = "EPFL, Ecole Polytechnique Federale de Lausanne"
__funding__ = "NCCR Digital Fabrication"
__version__ = "2024.08"
__license__ = "MIT License"
__repository__ = "https://github.com/nrogeau/Manis-timber-plate-joinery-solver"
__reference__ = "https://doi.org/10.1016/j.autcon.2021.103875"

import Grasshopper.Kernel as gh
import rhinoscriptsyntax as rs
import platesjoineryR8 as pj
reload(pj)
planes = None

if goal_module and stack_module:

    #default param
    if safe_spot is None: safe_spot = rs.PlaneFromNormal((1230,-1350,2020),(0,0,1))
    if up_dist is None or up_dist==0: up_dist = 100
    if retreat_dist is None or retreat_dist==0: retreat_dist = 10

    # initialization
    planes = []
    bases = []
    goals = []
    normals = []

    #auto-flip plates in stack
    for i in range(goal_module.count):
        if stack_module.plates[i].top_center[2] < stack_module.plates[i].bottom_center[2] :
            bases.append(stack_module.plates[i].bottom_plane)
            goals.append(goal_module.plates[i].bottom_plane)
            normals.append(goal_module.plates[i].bottom_normal)
        else :
            bases.append(stack_module.plates[i].top_plane)
            goals.append(goal_module.plates[i].top_plane)
            normals.append(goal_module.plates[i].top_normal)

    if len(bases) != len(goals):
        self.AddRuntimeMessage(Grasshopper.Kernel.GH_RuntimeMessageLevel.Error, 'start and goal model should have the same number of plates') 

    # plane and text list
    else:
        for i in range(goal_module.count):
            flag = True
            if (plates_id != []) and (plates_id != 'all') and (plates_id != None):
                flag = False
                for j in range(len(plates_id)):
                    if str(i) == plates_id[j]: flag = True
            if flag == True:

                #-------------------- SAFE PART (World) --------------------
    
                # safe_spot
                planes.append(safe_spot)
    
                #-------------------- BASE PART (model) --------------------
    
                # above_base
                above_base_point = rs.CopyObject(bases[i].Origin, (0,0,up_dist))
                above_base_plane = rs.PlaneFromFrame(above_base_point, bases[i].XAxis, bases[i].YAxis)
                planes.append(above_base_plane)
    
                # near_base
                near_base_point = rs.CopyObject(bases[i].Origin, (0,0,retreat_dist))
                near_base_plane = rs.PlaneFromFrame(near_base_point, bases[i].XAxis, bases[i].YAxis)
                planes.append(near_base_plane)
    
                #------------------- BASE PART (picture) -------------------
    
                # near_base
                planes.append(near_base_plane)
    
                # to_plate
                to_plate_point = rs.CopyObject(bases[i].Origin, (0,0, 0))
                to_plate_plane = rs.PlaneFromFrame(to_plate_point, bases[i].XAxis, bases[i].YAxis)
                planes.append(to_plate_plane)
    
                # near_base
                planes.append(near_base_plane)
    
                # above_base
                planes.append(above_base_plane)
    
                #-------------------- SAFE PART (World) --------------------
    
                # safe_spot
                planes.append(safe_spot)
    
                #------------------- GOAL PART (picture) -------------------
                
                # above_goal
                if goal_module.assembly_vectors[i] == 'gravity': 
                    near_goal_point = rs.CopyObject(goals[i].Origin, -retreat_dist * rs.VectorCreate((0,0,-1),(0,0,0)))
                else: near_goal_point = rs.CopyObject(goals[i].Origin, -retreat_dist * goal_module.assembly_vectors[i])
                above_goal_point = rs.CopyObject(near_goal_point, (0,0,up_dist))
                above_goal_plane = rs.PlaneFromFrame(above_goal_point, goals[i].XAxis,goals[i].YAxis)
                planes.append(above_goal_plane)
    
                # near_goal
                near_goal_plane = rs.PlaneFromFrame(near_goal_point, goals[i].XAxis,goals[i].YAxis)
                planes.append(near_goal_plane)
    
    
                # to_insert
                planes.append(goals[i])
    
                # retreat
                retreat_point = rs.CopyObject(goals[i].Origin, retreat_dist * normals[i])
                retreat_plane = rs.PlaneFromFrame(retreat_point, goals[i].XAxis, goals[i].YAxis)
                planes.append(retreat_plane)
    
                # above_retreat
                above_retreat = rs.CopyObject(retreat_point, (0,0,up_dist))
                retreat_plane = rs.PlaneFromFrame(above_retreat, goals[i].XAxis, goals[i].YAxis)
                planes.append(retreat_plane)
# ---------- end robot_trajectory ----------
display_trajectory = DisplayTrajectory(planes=robot_trajectory)
robosim = RobotSimulation(progression=Slider(0.6431, range=0..1), planes=robot_trajectory)  # -> end_effector_tcp, current_step
plate_simulation = PlateSimulation(
    stack_module=stack_model.model,
    goal_module=merge_joints_3.model,
    planes=robot_trajectory,
    tcp=robosim.end_effector_tcp,
    current_step=robosim.current_step)  # -> breps; inputs plates_id: list of String, planes: list of Plane, tcp: Plane, current_step: Int32, pick_step: Int32, drop_step: Int32
#   port stack_module: The plate module stacked in range of the robotic arm.
#   port goal_module: The plate module to assemble in range of the robotic arm.
#   port planes: The list of planes describing the trajectory of the robotic arm.
#   port current_step: The current step for the assembly.
#   port pick_step: The step where the robot should pick the plate.
#   port drop_step: The step where the robot should drop the plate.
#   port breps: Plates displayed according to robot movements.
# ---------- plate_simulation: Python ----------
__author__ = "Nicolas Rogeau"
__laboratory__ = "IBOIS, Laboratory for Timber Construction" 
__university__ = "EPFL, Ecole Polytechnique Federale de Lausanne"
__funding__ = "NCCR Digital Fabrication"
__version__ = "2024.08"
__license__ = "MIT License"
__repository__ = "https://github.com/nrogeau/Manis-timber-plate-joinery-solver"
__reference__ = "https://doi.org/10.1016/j.autcon.2021.103875"

import Grasshopper.Kernel as gh
import platesjoineryR8 as pj
import Rhino.Geometry as rg
import rhinoscriptsyntax as rs 
reload(pj)

if current_step is None: current_step = 0
if pick_step is None or pick_step==0: pick_step = 6
if drop_step is None or drop_step==0: drop_step = 11


display = []

if stack_module and goal_module and planes and tcp:
    goal = []
    stack = []
    for i in range(goal_module.count):
        flag = True
        if (plates_id != []) and (plates_id != 'all') and (plates_id != None):
            flag = False
            for j in range(len(plates_id)):
                if str(i) == plates_id[j]: flag = True
        if flag is True:
            goal.append(goal_module.plates[i].brep)
            stack.append(stack_module.plates[i].brep)

    #number of moves
    n = int(len(planes)/len(stack))
    # beginning phase
    if current_step < pick_step :
        display = stack
    
    # on move phase
    elif (current_step % n >= pick_step) and (current_step % n <= drop_step):
        plate_on_move = (current_step - current_step % n) / n
        for i in range(len(stack)):
            if i < plate_on_move: display.append(goal[i])
            if i == plate_on_move:
                start_plane = planes[current_step - current_step % n + pick_step-2]
                matrix = rg.Transform.PlaneToPlane(start_plane, tcp)
                obj = rs.TransformObject(rs.CopyObject(stack[i]), matrix)
                display.append(obj)
            if i > plate_on_move: display.append(stack[i])
    
    # stand still phase
    else:
        current_step = current_step - pick_step
        plate_on_move = (current_step - current_step % n) / n
        for i in range(len(stack)):
            if i <= plate_on_move: display.append(goal[i])
            if i > plate_on_move: display.append(stack[i])
    breps = display
# ---------- end plate_simulation ----------

brep_13 = Brep([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])
sequence_14 = DisplaySequence(breps=brep_13)
build_plate_model_13 = BuildPlateModel(run=True, breps=brep_13, sequence="[[0,1,2],[3,4,5]]")  # -> model, breps, sequence, log; inputs run: Boolean, breps: list of Brep, sequence: String, constraints: tree, discard: list of String; same code as build_plate_model
add_tenon_joint_3 = AddTenonJoint(
    model=build_plate_model_13.model,
    tenon_number=Slider(2, range=0..10),
    tenon_width=Slider(0.8, range=0..1),
    tenon_spacing=Slider(3, range=0..10),
    tenon_shift=Slider(1.2, range=0..10))  # -> model, joints_positives, joints_negatives, joints_keys; inputs plates_pairs: list of String, tenon_number: Int32, tenon_length: Double, tenon_width: Double, tenon_spacing: Double, tenon_shift: Double; same code as add_tenon_joint_2
split_decimal_2 = SplitDecimal(num=Slider(0, range=0..3))  # -> integer, decimal; inputs num: Double; same code as split_decimal

add_sunrise_joint_3 = AddSunriseJoint(
    model=add_tenon_joint_3.model,
    tenon_number=Slider(4, range=0..10),
    tenon_width=Slider(0.5, range=0..1),
    tenon_spacing=Slider(1.5, range=0..10),
    spread_angle=Slider(30, range=0..100))  # -> model, joints_positives, joints_negatives, joints_keys; inputs plates_pairs: list of String, tenon_number: Int32, tenon_width: Double, tenon_spacing: Double, spread_angle: Double, parallel_tenons: Boolean; same code as add_sunrise_joint

merge_joints_4 = MergeJoints(run=Toggle(True), model=add_sunrise_joint_3.model)  # -> model, breps, log; inputs run: Boolean, plates_ids: list of Int32, boolean_tol: Double, merge_tol: Double; same code as merge_joints
get_modules_2 = GetModules(model=merge_joints_4.model, module_id=split_decimal_2.integer)  # -> module, sequence, step; inputs module_id: Int32; same code as get_modules
plate_vectors = PlateVectors(module=get_modules_2.module)  # -> assembly_list, assembly_tree, relatives, spaces
#   port module: Plate module or plate model.
#   port assembly_list: Assembly vector of each plate in the module.
#   port assembly_tree: Assembly vector of each group of plates (sub-module) in the module.
#   port relatives: Neighbours concerned by the assembly.
#   port spaces: Intersection of insertion spaces with relatives.
# ---------- plate_vectors: Python ----------
__author__ = "Nicolas Rogeau"
__laboratory__ = "IBOIS, Laboratory for Timber Construction" 
__university__ = "EPFL, Ecole Polytechnique Federale de Lausanne"
__funding__ = "NCCR Digital Fabrication"
__version__ = "2024.08"
__license__ = "MIT License"
__repository__ = "https://github.com/nrogeau/Manis-timber-plate-joinery-solver"
__reference__ = "https://doi.org/10.1016/j.autcon.2021.103875"

import ast 
from Rhino.Geometry import Vector3d
import Grasshopper.Kernel as gh
import platesjoineryR8 as pj
reload(pj)

if module:
    if hasattr(module, 'model') is False:
        module = module.modules[-1]
    assembly_list = []
    assembly_tree = []
    seq = ast.literal_eval(module.sequence)
    for i in range(len(seq)):
        plate_ids = pj.Toolbox.Data.flatten_integer_list(seq[i])
        if type(plate_ids) is list:
            n = len(plate_ids)
        else: n = 1
        print plate_ids, n
        vec = module.assembly_vectors[i]
        if vec == "gravity": vec = Vector3d(0,0,-1)
        assembly_list.extend([vec] * n)
        assembly_tree.append([vec])
    assembly_tree = pj.Toolbox.Data.list_to_datatree(assembly_tree)
    relatives = pj.Toolbox.Data.list_to_datatree(module.assembly_relatives)
    spaces = pj.Toolbox.Data.list_to_datatree(module.assembly_spaces)
else:
    ghenv.Component.AddRuntimeMessage(gh.GH_RuntimeMessageLevel.Warning, "Waiting to get a module or model as input.")
# ---------- end plate_vectors ----------
animate_assembly_6 = AnimateAssembly(module=get_modules_2.module, progress=split_decimal_2.decimal, retreat=Slider(10, range=0..10))  # -> breps, status; inputs progress: Double, retreat: Double; same code as animate_assembly
panel_8 = Panel(plate_vectors.relatives)

brep_14 = Brep([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])
build_plate_model_14 = BuildPlateModel(run=True, breps=brep_14)  # -> model, breps, sequence, log; inputs run: Boolean, breps: list of Brep, sequence: String, constraints: tree, discard: list of String; same code as build_plate_model
add_tenon_joint_4 = AddTenonJoint(model=build_plate_model_14.model, tenon_number=Slider(1, range=0..1), tenon_width=Slider(2, range=0..10))  # -> model, joints_positives, joints_negatives, joints_keys; inputs plates_pairs: list of String, tenon_number: Int32, tenon_length: Double, tenon_width: Double, tenon_spacing: Double, tenon_shift: Double; same code as add_tenon_joint_2
# DESIGN-TO-FABRICATION
add_half_lap_joint_2 = AddHalfLapJoint(model=add_tenon_joint_4.model)  # -> model, joints_positives, joints_negatives, joints_keys; inputs plates_pairs: list of String, proportion: Double, tolerance: Double, min_angle: Double, straight_height: Double, fillet_height: Double, segments: Int32; same code as add_half_lap_joint
number_slider_8 = Slider(1, range=0..1)
panel_9 = Panel("""(0,1)
(0,3)""")
number_slider_9 = Slider(0.001, range=0..0.001)
sqgrid = Square(
    Plane=PlaneXY(95, 19.06747828, 0),
    Size=Slider(24, range=0..100),
    ExtentX=Slider(2, range=0..10),
    ExtentY=Slider(3, range=0..10))  # -> Cells, Points
geo_6 = Geometry(flatten(sqgrid.Cells))
area = Area(Geometry=geo_6)  # -> Area, Centroid

add_sunrise_joint_4 = AddSunriseJoint(
    model=add_half_lap_joint_2.model,
    plates_pairs=panel_9,
    tenon_number=number_slider_8,
    tenon_width=number_slider_8,
    tenon_spacing=number_slider_8)  # -> model, joints_positives, joints_negatives, joints_keys; inputs plates_pairs: list of String, tenon_number: Int32, tenon_width: Double, tenon_spacing: Double, spread_angle: Double, parallel_tenons: Boolean; same code as add_sunrise_joint
add_sunrise_joint_5 = AddSunriseJoint(
    model=add_sunrise_joint_4.model,
    plates_pairs="(4,5)",
    tenon_number=Slider(4, range=0..10),
    tenon_width=number_slider_8,
    tenon_spacing=number_slider_8,
    spread_angle=Slider(30, range=0..100))  # -> model, joints_positives, joints_negatives, joints_keys; inputs plates_pairs: list of String, tenon_number: Int32, tenon_width: Double, tenon_spacing: Double, spread_angle: Double, parallel_tenons: Boolean; same code as add_sunrise_joint

merge_joints_5 = MergeJoints(run=True, model=add_sunrise_joint_5.model, boolean_tol=number_slider_9, merge_tol=number_slider_9)  # -> model, breps, log; inputs run: Boolean, plates_ids: list of Int32, boolean_tol: Double, merge_tol: Double; same code as merge_joints
animate_assembly_7 = AnimateAssembly(module=merge_joints_5.model, progress=Slider(1, range=0..1), retreat=Slider(10, range=0..10))  # -> breps, status; inputs progress: Double, retreat: Double; same code as animate_assembly
dispatch_model = DispatchModel(model=merge_joints_5.model, custom=area.Centroid)  # -> model, breps; inputs plane: Plane, step: Vector3d, flip: list of String, custom: list of Point3d
#   port plane: Array location and orientation.
#   port step: Step between two plates as vector.
#   port flip: (Optional) List of plates to flip.
#   port custom: (Optional) Custom list of points to use for the array.
#   port model: Transformed plate model.
#   port breps: Transformed breps.
# ---------- dispatch_model: Python ----------
__author__ = "Nicolas Rogeau"
__laboratory__ = "IBOIS, Laboratory for Timber Construction" 
__university__ = "EPFL, Ecole Polytechnique Federale de Lausanne"
__funding__ = "NCCR Digital Fabrication"
__version__ = "2024.08"
__license__ = "MIT License"
__repository__ = "https://github.com/nrogeau/Manis-timber-plate-joinery-solver"
__reference__ = "https://doi.org/10.1016/j.autcon.2021.103875"

import copy
import Rhino.Geometry as rg
import Grasshopper.Kernel as gh
import platesjoineryR8 as pj
reload(pj)

if model:
    model = copy.deepcopy(model)
    if custom: transform_type = "Custom"
    else : transform_type = "Array"
    model.transform(transform_type, plane, step, flip, custom)
    breps = []
    for i in range(model.count):
        breps.append(model.plates[i].brep)

else:
    ghenv.Component.AddRuntimeMessage(gh.GH_RuntimeMessageLevel.Warning, "Waiting to get a model as input.")
# ---------- end dispatch_model ----------
generate_toolpath = GenerateToolpath(
    run=True,
    model=dispatch_model.model,
    contour_tool_radius=Slider(0.2, range=0.01..0.3),
    holes_tool_radius=Slider(0.1, range=0.1..0.2),
    notch=Toggle(True),
    cylinder=Toggle(True),
    limit=Slider(5, range=0..10),
    tbone=Toggle(False))  # -> model, top_milling_contour, bottom_milling_contour, top_milling_holes, bottom_milling_holes; inputs run: Boolean, plates_id: list of String, contour_tool_radius: Double, holes_tool_radius: Double, notch: Boolean, cylinder: Boolean, limit: Double, tbone: Boolean, switch: list of Int32
#   port run: Generate toolpath if run is True.
#   port plates_id: (Optional) List of plates to only merge joints for those plates.
#   port contour_tool_radius: Radius of tool used to cut the contour.
#   port holes_tool_radius: Radius of tool used to cut the holes.
#   port notch: Generate notches in corners for insertion.
#   port cylinder: If notch is True, generate cylinders as joints_negatives for detailed vizualization of the notches.
#   port limit: (optional) Limit the angle of the corners for which a notch should be created.
#   port tbone: Change notch style: Dog-bone if False, T-bone if True.
#   port switch: (optional) List of plates for which the top and bottom planes should be switched.
#   port model: Updated plate model.
#   port top_milling_contour: Top polyline for contour milling toolpath.
#   port bottom_milling_contour: Bottom polyline for contour milling toolpath.
#   port top_milling_holes: Top polyline for holes milling toolpath.
#   port bottom_milling_holes: Bottom polyline for holes milling toolpath.
# ---------- generate_toolpath: Python ----------
__author__ = "Nicolas Rogeau"
__laboratory__ = "IBOIS, Laboratory for Timber Construction" 
__university__ = "EPFL, Ecole Polytechnique Federale de Lausanne"
__funding__ = "NCCR Digital Fabrication"
__version__ = "2024.08"
__license__ = "MIT License"
__repository__ = "https://github.com/nrogeau/Manis-timber-plate-joinery-solver"
__reference__ = "https://doi.org/10.1016/j.autcon.2021.103875"

import copy
import Grasshopper.Kernel as gh
import platesjoineryR8 as pj 
reload(pj)

if model:
    if run is True or run == None:
        model = copy.deepcopy(model)
        model.get_fabrication_lines(plates_id, contour_tool_radius, holes_tool_radius, notch, cylinder, limit, tbone)
        model.switch_top_bottom(switch)
        top_milling_contour =  [[plate.top_milling_contour] for plate in model.plates]
        bottom_milling_contour  = [[plate.bottom_milling_contour]  for plate in model.plates]
        top_milling_holes =  [plate.top_milling_holes for plate in model.plates]
        bottom_milling_holes  = [plate.bottom_milling_holes for plate in model.plates]
        top_milling_contour = pj.Toolbox.Data.list_to_datatree(top_milling_contour)
        bottom_milling_contour = pj.Toolbox.Data.list_to_datatree(bottom_milling_contour)
        top_milling_holes = pj.Toolbox.Data.list_to_datatree(top_milling_holes)
        bottom_milling_holes = pj.Toolbox.Data.list_to_datatree(bottom_milling_holes)
else:
    ghenv.Component.AddRuntimeMessage(gh.GH_RuntimeMessageLevel.Warning, "Waiting to get a model as input.")
# ---------- end generate_toolpath ----------
plate_toolpath = PlateToolpath(model=generate_toolpath.model)  # -> top_milling_contour, bottom_milling_contour, top_milling_holes, bottom_milling_holes
#   port top_milling_contour: Top polyline for contour milling toolpath.
#   port bottom_milling_contour: Bottom polyline for contour milling toolpath.
#   port top_milling_holes: Top polyline for holes milling toolpath.
#   port bottom_milling_holes: Bottom polyline for holes milling toolpath.
# ---------- plate_toolpath: Python ----------
__author__ = "Nicolas Rogeau"
__laboratory__ = "IBOIS, Laboratory for Timber Construction" 
__university__ = "EPFL, Ecole Polytechnique Federale de Lausanne"
__funding__ = "NCCR Digital Fabrication"
__version__ = "2024.08"
__license__ = "MIT License"
__repository__ = "https://github.com/nrogeau/Manis-timber-plate-joinery-solver"
__reference__ = "https://doi.org/10.1016/j.autcon.2021.103875"

import Grasshopper.Kernel as gh
import platesjoineryR8 as pj 
reload(pj)

if model:
    top_milling_contour = [plate.top_milling_contour for plate in model.plates]
    bottom_milling_contour = [plate.bottom_milling_contour for plate in model.plates]
    top_milling_holes = [plate.top_milling_holes for plate in model.plates]
    bottom_milling_holes = [plate.bottom_milling_holes for plate in model.plates]
    top_milling_holes = pj.Toolbox.Data.list_to_datatree(top_milling_holes)
    bottom_milling_holes = pj.Toolbox.Data.list_to_datatree(bottom_milling_holes)
else:
    ghenv.Component.AddRuntimeMessage(gh.GH_RuntimeMessageLevel.Warning, "Waiting to get a model as input.")
# ---------- end plate_toolpath ----------
plate_joints = PlateJoints(model=generate_toolpath.model)  # -> joints_positives, joints_negatives, joints_keys
#   port joints_positives: The joints to add to each plate.
#   port joints_negatives: The joints to subtract from each plate.
#   port joints_keys: The keys to insert in each plate.
# ---------- plate_joints: Python ----------
__author__ = "Nicolas Rogeau"
__laboratory__ = "IBOIS, Laboratory for Timber Construction" 
__university__ = "EPFL, Ecole Polytechnique Federale de Lausanne"
__funding__ = "NCCR Digital Fabrication"
__version__ = "2024.08"
__license__ = "MIT License"
__repository__ = "https://github.com/nrogeau/Manis-timber-plate-joinery-solver"
__reference__ = "https://doi.org/10.1016/j.autcon.2021.103875"

import Grasshopper.Kernel as gh
import platesjoineryR8 as pj 
reload(pj)

if model:
    joints_positives = [plate.joints_positives for plate in model.plates]
    joints_negatives = [plate.joints_negatives for plate in model.plates]
    joints_keys = [plate.joints_keys for plate in model.plates]
    joints_positives = pj.Toolbox.Data.list_to_datatree(joints_positives)
    joints_negatives = pj.Toolbox.Data.list_to_datatree(joints_negatives)
    joints_keys = pj.Toolbox.Data.list_to_datatree(joints_keys)
else:
    ghenv.Component.AddRuntimeMessage(gh.GH_RuntimeMessageLevel.Warning, "Waiting to get a model as input.")
# ---------- end plate_joints ----------
merge_joints_6 = MergeJoints(
    run=Toggle(True),
    model=generate_toolpath.model,
    boolean_tol=Slider(0.0001, range=0..0.0001),
    merge_tol=Slider(0.001, range=0..0.001))  # -> model, breps, log; inputs run: Boolean, plates_ids: list of Int32, boolean_tol: Double, merge_tol: Double; same code as merge_joints
sequence_15 = DisplaySequence(breps=merge_joints_6.breps)
preview = CustomPreview(
    Geometry=[plate_toolpath.bottom_milling_contour, plate_toolpath.top_milling_contour, plate_toolpath.top_milling_holes, plate_toolpath.bottom_milling_holes],
    Material=ColourSwatch(SwatchColor=RGB(50, 150, 150)))
preview_2 = CustomPreview(Geometry=plate_joints.joints_negatives, Material=ColourSwatch(SwatchColor=RGBA(250, 200, 50, 50)))

sequence_16 = DisplaySequence(breps=merge_joints_5.breps)

# ==== cluster DisplayTrajectory: Display robot trajectory
planes = ClusterInput()
pline = PolyLine(Vertices=planes, Closed=False)
dash = Dash(curve=pline, dash_size=Slider(20, range=0..20))
preview = CustomPreview(Geometry=dash, Material=ColourSwatch(SwatchColor=RGB(150, 250, 50)))

# ==== cluster RobotSimulation: Open cluster to edit TCP parameters. (Requires the installation of Robots plugin)
list = RobotsLibrary({"IBOIS-IRB6400 (missing)": "IBOIS-IRB6400"}, selected="IBOIS-IRB6400 (missing)", Type=0)

M = Mesh(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)
load_robot = LoadRobotSystem(Name=list, Base=PlaneXY(0, 0, 517))
tool = CreateTool(
    Name="Gripper",
    TCP=Plane(origin=(-0.5571569993, 5.148699728, 302.9841578), x=(0.002205531405, 0.9999627875, -0.008340218136), y=(0.9999946005, -0.002185130368, 0.002454425213)),
    Weight=0,
    Mesh=M)  # -> Tool, TCP
tool_2 = Data(tool.Tool)
degtorad = DegreesToRadians(Degrees=[0, 0, 0, 0, 0, 0], RobotSystem=load_robot, MechanicalGroup=0)
list_2 = ValueList({"Joint", "Linear"}, selected="Joint")
planes = ClusterInput()
target = CreateTarget(Joints=degtorad, Tool=tool_2, IsCartesian=False)
target_2 = CreateTarget(Plane=planes, Motion=list_2, Tool=tool_2, IsCartesian=True)

merge = Merge(Data1=flatten(target), Data2=flatten(target_2))  # -> flatten(Result)
program = CreateProgram(Name="DefaultProgram", RobotSystem=load_robot, Targets1=merge, StepSize=1)  # -> Program, flatten(Code), Duration, Warnings, Errors
progression = ClusterInput()
sim = ProgramSimulation(Program=program.Program, Time=progression, Normalized=True)  # -> SystemMeshes, JointRotations, Plane, Index, Time, Program, Errors
item = ListItem(List=sim.Plane, Index=-1, Wrap=True)
current_step = ClusterOutput(sim.Index)
pln = Plane(item)
end_effector_tcp = ClusterOutput(pln)

lng = ListLength(List=program.Errors)
brep = Brep(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)
dispatch = Dispatch(List=[brep, sim.SystemMeshes], DispatchPattern=lng)  # -> ListA, ListB
preview = CustomPreview(Geometry=dispatch.ListB, Material=ColourSwatch(SwatchColor=RGBA(100, 150, 150, 150)))
preview_2 = CustomPreview(Geometry=dispatch.ListA, Material=ColourSwatch(SwatchColor=RGBA(200, 150, 150, 150)))

# ==== cluster DisplaySequence: Display a colorful assembly sequence with element IDs oriented to face the viewer. Use Grasshopper's 'Trigger' component to refresh the visualization continuously for real-time updates.
breps = ClusterInput()  # Plate as Brep

# ---- group: Brep
dom = ConstructDomain(DomainStart=Slider(0, range=0..1), DomainEnd=Slider(0.3, range=0..1))
lng = ListLength(List=breps)
range = Range(Domain=dom, Steps=lng)
hsl = ColourHSL(Alpha=Slider(0, range=0..1), Hue=range, Saturation=Slider(1, range=0..1), Luminance=Slider(0.6, range=0..1))
preview = CustomPreview(Geometry=breps, Material=hsl)

# ---- group: Text
py3 = Python3Script(x=breps)  # -> out, screen_plane; inputs x: list
# ---------- py3: Python ----------
import Rhino
import Rhino.Geometry as rg

# Get the active Rhino viewport
viewport = Rhino.RhinoDoc.ActiveDoc.Views.ActiveView.ActiveViewport

# Camera position, target, and up vector
camera_location = viewport.CameraLocation
camera_target = viewport.CameraTarget
up_vector = viewport.CameraUp

# View direction (Z-axis of the screen)
view_direction = camera_target - camera_location
view_direction.Unitize()

# Right vector (X-axis of the screen) = Cross product of up vector and view direction
right_vector = rg.Vector3d.CrossProduct(up_vector, view_direction)
right_vector.Unitize()

# Recalculate the up vector (Y-axis of the screen) to ensure orthogonality
top_vector = rg.Vector3d.CrossProduct(view_direction, right_vector)
top_vector.Unitize()

# Create the plane
screen_plane = rg.Plane(camera_location, -right_vector, top_vector)
# ---------- end py3 ----------
area = Area(Geometry=breps)  # -> Area, Centroid
index = ItemIndex(List=breps, Item=breps)
vec2pt = Vector2Pt(PointA=py3.screen_plane, PointB=area.Centroid, Unitize=False)  # -> Vector, Length
sqrt = SquareRoot(Value=area.Area)
move = Move(Geometry=py3.screen_plane, Motion=vec2pt.Vector)  # -> Geometry, Transform
division = Division(A=sqrt, B=10)
tag = TextTag3D(Location=move.Geometry, Text=index, Size=division, Colour=ColourSwatch(SwatchColor=RGB(255, 255, 255)), Justification=5)

# ==== cluster Dash
curve = ClusterInput()
dash_size = ClusterInput()
len = Length(Curve=curve)
division = Division(A=len, B=dash_size)
divide = DivideCurve(Curve=curve, Count=division, Kinks=True)  # -> Points, Tangents, Parameters
shift = ShiftList(List=divide.Points, Shift=1, Wrap=False)
ln = Line(StartPoint=divide.Points, EndPoint=shift)
cull = CullPattern(List=ln, CullPattern=[False, True])
crv = Curve(cull)
dashed_line = ClusterOutput(crv)
